# Grasshopper definition Parametric Continuum Robot with Kinematics.gh (Grasshopper 1.0.7)
# plug-ins: Human UI

string_pull = Slider(2.8, range=0..42)
# String Pull (delta_l)
internotch_length = Slider(6.2, range=1..42)
# Inner Radius i/p (ri)
# Tip Outer Radius i/p (ro)
inner_radius = Slider(4.9, range=1..20)
# Base Outer Radius i/p (rb)
outer_radius = Slider(7.2, range=2..22)
# Base Height (Lb)
base_outer_radius = Slider(20, range=5..30)
# Notch Width (g)
base_height = Slider(5, range=5..20)
# Notch Length (h)
notch_width = Slider(9.765, range=1..41)
# Number of Notches (n)
notch_length = Slider(13.271, range=1..42)
# Internotch Length (c)
number_of_notches = Slider(3, range=3..20)
xy_plane = XYPlane(Origin=Point(0, 0, 0))
cylinder_parameters = Slider(68, range=0..100)
cylinder_parameters_2 = Slider(84, range=0..100)
cylinder = Cylinder(Base=xy_plane, Radius=cylinder_parameters, Length=cylinder_parameters_2)
create_3d_view = Create3DView(
    MeshToDisplay=cylinder,
    MeshColors=RGB(255, 0, 0),
    ViewWidth=Slider(920, range=0..1920),
    ViewHeight=Slider(920, range=0..1080))
create_color_picker = CreateColorPicker(DefaultColor=ColourSwatch(SwatchColor=RGB(173, 173, 173)))
create_slider = CreateSlider(
    Slider=[inner_radius, outer_radius, base_outer_radius, base_height, notch_width, notch_length, number_of_notches, internotch_length, string_pull],
    ShowBounds=False,
    ShowTicks=False,
    ShowTooltip=False,
    ShowValLabel=True,
    showLabel=True)
create_label = CreateLabel(LabelSize=Slider(16, range=0..100), Justification=0)
create_label_2 = CreateLabel(LabelText="ERROR INFORMATION", LabelSize=Slider(16, range=0..100), Justification=0)
merge = Merge(Data1=create_slider, Data2=create_color_picker, Data3=create_label_2, Data4=create_label)

# ----
# Add border
number_slider = Slider(1, range=0..10)
create_border = CreateBorder(
    UIElement=create_3d_view,
    BorderThickness=number_slider,
    BorderColor=ColourSwatch(SwatchColor=RGB(94, 94, 94)),
    CornerRadius=Slider(30, range=0..100))

# ----
# Position the 3D model
boolean_toggle = BooleanToggle(False)
value_list = ValueList({"Left": 0, "Center": 1, "Right": 2}, selected="Center")
adjust_element_positioning = AdjustElementPositioning(
    ElementsToAdjust=create_border,
    Margin=Slider(10, range=0..100),
    AbsolutePositioning=boolean_toggle,
    Width=Slider(920, range=0..1280),
    Height=Slider(920, range=0..1080),
    HorizontalAlignment=value_list)

panel = Panel("""580
580
580
580
580
580
580
580
580
580
580
580""")

# ----
# Create Rows
number_slider_2 = Slider(500, range=0..1000)
panel_2 = Panel("""35
35
35
35
35
35
35
35
35
35
35
35""")
panel_3 = Panel("""0
1
2
3
4
5
6
7
8
9
10
11""")
create_grid = CreateGrid(
    UIElements=merge,
    Width=Slider(600, range=0..1000),
    Height=number_slider_2,
    RowDefinitions=panel_2,
    ColumnDefinitions=panel,
    ElementRow=panel_3,
    ElementRowSpan=1,
    ElementColumnSpan=1)

create_expander = CreateExpander(UIElements=create_grid, Header="EDIT PARAMETERS:", Open=Toggle(True))

create_label_3 = CreateLabel(LabelText="null", LabelSize=Slider(15, range=0..100), Justification=0)
create_label_4 = CreateLabel(LabelText="Radius of Curvature (mm)", LabelSize=Slider(18, range=0..100), Justification=0)

# ----
# Position the control elements
boolean_toggle_2 = BooleanToggle(False)
value_list_2 = ValueList({"Left": 0, "Center": 1, "Right": 2}, selected="Left")
adjust_element_positioning_2 = AdjustElementPositioning(
    ElementsToAdjust=merge,
    Margin=Slider(0, range=0..1000),
    AbsolutePositioning=boolean_toggle_2,
    Width=panel,
    Height=panel_2,
    HorizontalAlignment=value_list_2)

# ----
# Position the control elements
# Create Rows
panel_4 = Panel("CONSTRAINTS:")
create_label_5 = CreateLabel(LabelText=panel_4, LabelSize=Slider(18, range=0..100), Justification=0)
create_label_6 = CreateLabel(LabelText="1mm < Inner Radius (Ri) < 19mm", LabelSize=Slider(14, range=0..100), Justification=0)
create_label_7 = CreateLabel(LabelText="2mm <= Outer Radius (Ro) <= 22mm", LabelSize=Slider(14, range=0..100), Justification=0)
create_label_8 = CreateLabel(LabelText="5mm <= Base Radius (Rb) <= 30mm", LabelSize=Slider(14, range=0..100), Justification=0)
create_label_9 = CreateLabel(LabelText=" 5mm <= Base Length (Lb) <= 20mm", LabelSize=Slider(14, range=0..100), Justification=0)
create_label_10 = CreateLabel(LabelText="3 <= Number of Notches (n) <= 20", LabelSize=Slider(14, range=0..100), Justification=0)
create_label_11 = CreateLabel(LabelText="Ro - Ri <= Notch Width (g) <= Ro + Ri", LabelSize=Slider(14, range=0..100), Justification=0)
create_label_12 = CreateLabel(LabelText="Ro - Ri <= Notch Length(h) <= Ro + Ri", LabelSize=Slider(14, range=0..100), Justification=0)
create_label_13 = CreateLabel(LabelText="Ro - Ri <= Internotch Length (a) <= Ro + Ri", LabelSize=Slider(14, range=0..100), Justification=0)
create_label_14 = CreateLabel(LabelText="0 <= String Pull (Delta_l) <= Ro + Ri", LabelSize=Slider(14, range=0..100), Justification=0)
merge_2 = Merge(
    Data1=create_label_5,
    Data2=create_label_6,
    Data3=create_label_7,
    Data4=create_label_8,
    Data5=create_label_9,
    Data6=create_label_10,
    Data7=create_label_11,
    Data8=create_label_12,
    Data9=create_label_13,
    Data10=create_label_14)
panel_5 = Panel("""30
30
30
30
30
30
30
30
30
30""")
panel_6 = Panel("""500
500
500
500
500
500
500
500
500
500""")
number_slider_3 = Slider(500, range=0..1000)
panel_7 = Panel("""0
1
2
3
4
5
6
7
8
9""")
value_list_3 = ValueList({"Left": 0, "Center": 1, "Right": 2}, selected="Right")
create_grid_2 = CreateGrid(
    UIElements=merge_2,
    Width=Slider(500, range=0..1000),
    Height=Slider(500, range=0..1000),
    RowDefinitions=panel_5,
    ColumnDefinitions=panel_6,
    ElementRow=panel_7,
    ElementRowSpan=1,
    ElementColumnSpan=1)
create_expander_2 = CreateExpander(UIElements=create_grid_2, Header="VIEW CONSTRAINTS", Open=Toggle(True))
adjust_element_positioning_3 = AdjustElementPositioning(
    ElementsToAdjust=merge_2,
    Margin=Slider(0, range=0..1000),
    AbsolutePositioning=Toggle(False),
    Width=panel_6,
    Height=panel_5,
    HorizontalAlignment=value_list_3)

get_screen_dimensions = GetScreenDimensions()  # -> Width, Height

# ----
# Base Extrude
# rb
# Lb
construct_point = ConstructPoint(XCoordinate=0, YCoordinate=0, ZCoordinate=0)

# ----
# ri
# ro
# cval
# Lb
# rb
# Lb
# Mounting Holes and Wire Insert
number_slider_4 = Slider(2, range=0..10)

# ----
# theta_eff
# cval
# Lb
# hval
# delta_l
# hval
# r_eff
# y_bar
# theta_eff
# ri
# Linear Transformation
# ro
# theta_eff
# A
# Theta Rotate
# B
# cval
# R0
# C
# n
# n
y_plane = Slider(0, range=0..100)

# ----
# Update Values
value_listener = ValueListener(Elements=create_slider, SomeProperty=True)  # -> Values, Indices
value_listener_2 = ValueListener(Elements=create_color_picker, SomeProperty=True)  # -> Values, Indices
explode_tree = ExplodeTree(Data=value_listener.Values)  # -> Branch0, Branch1, Branch2, Branch3, Branch4, Branch5, Branch6, Branch7, Branch8

# ----
# n
integer = Integer(explode_tree.Branch6)
# Lb
# ri
number = Number(explode_tree.Branch3)
# rb
number_2 = Number(explode_tree.Branch2)
ghpython_script = GhPythonScript(
    ri=explode_tree.Branch0,
    ro=explode_tree.Branch1,
    g=explode_tree.Branch4,
    h=explode_tree.Branch5,
    n=explode_tree.Branch6,
    c=explode_tree.Branch7)  # -> out, ri, ro, gval, hval, y_bar, cval
# ---------- ghpython_script: Python ----------
__author__ = "arjun"
__version__ = "2023.11.15"

import math

def calculate_parameters(ri, ro, gval, hval):
    """
    Calculate the parameters based on the given inputs.

    Parameters:
    ri (float): Inner radius.
    ro (float): Outer radius.
    g (float): Gap parameter.
    h (float): Height parameter.

    Returns:
    tuple: Contains calculated values of phi_o, phi_i, Ao, Ai, y_bar_o, y_bar_i.
    """

    # Step 2: Calculate φo and φi
    phi_o = 2 * math.acos((gval - ro) / ro)
    phi_i = 2 * math.acos((gval - ro) / ri)

    # Step 3: Calculate Ao and Ai
    Ao = ro**2 * (phi_o - math.sin(phi_o)) / 2
    Ai = ri**2 * (phi_i - math.sin(phi_i)) / 2

    # Step 4: Calculate y_bar_o and y_bar_i
    y_bar_o = (4 * ro * math.sin(phi_o / 2)**3 )/ (3 * (phi_o - math.sin(phi_o)))
    y_bar_i = (4 * ri * math.sin(phi_i / 2)**3) / (3 * (phi_i - math.sin(phi_i)))
    
    # Step 5: Calculate y_bar
    y_bar = (y_bar_o * Ao - y_bar_i * Ai) / (Ao - Ai)

    return phi_o, phi_i, Ao, Ai, y_bar_o, y_bar_i, y_bar

# Example usage of the function
# These lines would be replaced with inputs from Grasshopper components
#ri = 0.5  # Example value for inner radius
#ro = 1.0  # Example value for outer radius
#g = 0.8   # Example value for gap parameter
#h = 1.5   # Example value for height parameter

# Adjusting values based on the specified conditions
if ri >= (ro - 2):
    ro = ri + 2

if ri == 0:
    ri = 1

hval = h
gval = g
#delta_l=0
max_limit = ro + ri
min_limit = ro - ri

if g >= max_limit:
    gval = max_limit
    print str("g constrained to upper limit")
elif g < min_limit:
    gval = min_limit
    print str("g constrained to lower limit")
else:
    gval = g

if h >= max_limit:
    hval = max_limit
    print str("h constrained to upper limit")
elif h < min_limit:
    hval = min_limit
    print str("h constrained to lower limit")
else:
    hval = h

if c >= max_limit:
    cval = max_limit
    print str("c constrained to upper limit")
elif c < min_limit:
    cval = min_limit
    print str("c constrained to lower limit")
else:
    cval = c


# Calculating the parameters
phi_o, phi_i, Ao, Ai, y_bar_o, y_bar_i, y_bar = calculate_parameters(ri, ro, gval, hval)
# ---------- end ghpython_script ----------
number_3 = Number(ghpython_script.ri)
# ro
number_4 = Number(ghpython_script.ro)

number_5 = Number(number_4)
number_6 = Number(number_3)
number_7 = Number(ghpython_script.cval)
number_8 = Number(number_2)
subtraction = Subtraction(A=number_8, B=number_5)
subtraction_2 = Subtraction(A=number_5, B=number_6)
division = Division(A=subtraction, B=number_slider_4)
division_2 = Division(A=subtraction_2, B=Slider(2, range=0..10))
addition = Addition(A=number_5, B=division)
number_9 = Number(number)
addition_2 = Addition(A=division_2, B=number_6)
addition_3 = Addition(A=number_9, B=number_7)
construct_point_2 = ConstructPoint(XCoordinate=addition, YCoordinate=0, ZCoordinate=0)
construct_point_3 = ConstructPoint(XCoordinate=addition_2, YCoordinate=0, ZCoordinate=0)
unit_z = UnitZ(Factor=addition_3)
circle = Circle(Plane=construct_point_2, Radius=Slider(3.4, range=0..3.4))
number_10 = Number(number)
circle_2 = Circle(Plane=construct_point_3, Radius=Slider(0.6, range=0..1))
polar_array = PolarArray(Geometry=circle, Plane=PlaneXY(0, 0, 0), Count=Slider(4, range=0..10), Angle=6.283185307)  # -> Geometry, Transform
unit_z_2 = UnitZ(Factor=number_10)
polar_array_2 = PolarArray(Geometry=circle_2, Plane=PlaneXY(0, 0, 0), Count=Slider(1, range=0..10), Angle=6.283185307)  # -> Geometry, Transform
extrude = Extrude(Base=polar_array_2.Geometry, Direction=unit_z)  # -> flatten(Extrusion)
extrude_2 = Extrude(Base=polar_array.Geometry, Direction=unit_z_2)  # -> flatten(Extrusion)
cap_holes = CapHoles(Brep=[extrude, extrude_2])

panel_8 = Panel(ghpython_script.out)

# ----
# cval
# Lb
# ri
# ro
# hval
# gval
# Notch Segment
# hval
number_11 = Number(number_7)
number_12 = Number(number)
addition_4 = Addition(A=number_11, B=number_12)
number_13 = Number(ghpython_script.gval)
number_14 = Number(number_6)
number_15 = Number(number_5)
number_16 = Number(ghpython_script.hval)
subtraction_3 = Subtraction(A=number_15, B=number_13)
construct_point_4 = ConstructPoint(XCoordinate=0, YCoordinate=0, ZCoordinate=addition_4)
unit_z_3 = UnitZ(Factor=number_16)
negative = Negative(Value=number_15)
circle_3 = Circle(Plane=construct_point_4, Radius=number_14)
circle_4 = Circle(Plane=construct_point_4, Radius=number_15)
multiplication = Multiplication(A=Slider(2, range=0..10), B=number_15)
construct_point_5 = ConstructPoint(XCoordinate=subtraction_3, YCoordinate=negative, ZCoordinate=addition_4)
rectangle = Rectangle(Plane=construct_point_5, XSize=number_13, YSize=multiplication, Radius=0)  # -> Rectangle, Length
number_17 = Number(number_16)
ruled_surface = RuledSurface(CurveA=circle_3, CurveB=circle_4)
extrude_3 = Extrude(Base=ruled_surface, Direction=unit_z_3)
box_rectangle = BoxRectangle(Rectangle=rectangle.Rectangle, Height=number_17)
split_brep = SplitBrep(Brep=extrude_3, Cutter=box_rectangle)
list_item = ListItem(List=split_brep, Index=Slider(2, range=0..10), Wrap=True)
cap_holes_2 = CapHoles(Brep=list_item)
brep = Brep(cap_holes_2)

# ----
# delta_l
number_18 = Number(explode_tree.Branch8)

integer_2 = Integer(integer)
number_19 = Number(number_7)
number_20 = Number(number)
number_21 = Number(explode_tree.Branch8)
number_22 = Number(number_4)
number_23 = Number(ghpython_script.hval)
number_24 = Number(ghpython_script.y_bar)
number_25 = Number(number_3)
ghpython_script_2 = GhPythonScript(delta_l=number_21, hval=number_23, y_bar=number_24, ri=number_25, ro=number_22)  # -> out, r_eff, theta_eff
# ---------- ghpython_script_2: Python ----------
__author__ = "arjun"
__version__ = "2023.11.17"

import rhinoscriptsyntax as rs
import cmath

def solve_quadratic(A, B, C):
    # Calculate the discriminant
    discriminant = cmath.sqrt(B**2 - 4*A*C)

    # Calculate two solutions
    x1 = (-B + discriminant) / (2 * A)
    x2 = (-B - discriminant) / (2 * A)
    if x1.real >= 0:
        return x1
    else:
        return x2
    return x

if delta_l > 0:
    #delta_l = 0.5  # Example value for delta_l
    kappa_approximation = True  # Set to True for approximation in equation (E)
    
    # Step 6: Calculate kappa
    # For small angles, an approximation can be used
    if kappa_approximation:
        kappa = delta_l / (hval * (ri + y_bar) - delta_l * y_bar)
        # For large angles, a more accurate method might be required
        # Placeholder for a more complex calculation or numerical method

    # Step 7: Calculate s
    s = hval / (1 + (y_bar * kappa))
    r = 1 / kappa
    theta = s/r
    theta_max  = (hval) / (ro + y_bar)
    if theta > theta_max:
        theta_eff = theta_max - 0.0174533
        #solving for k that meets this theta_max condition
        A = y_bar
        B = 1
        C = (-hval/theta_max)
        k_eff = solve_quadratic(A, B, C)
        print str("bending constrained to upper limit")
        r_eff = ro
    else:
        theta_eff = theta
        k_eff = kappa
        r_eff = r
# ---------- end ghpython_script_2 ----------
addition_5 = Addition(A=number_19, B=number_20)
number_26 = Number(ghpython_script_2.r_eff)
number_27 = Number(ghpython_script_2.theta_eff)
negative_2 = Negative(Value=number_22)
construct_point_6 = ConstructPoint(XCoordinate=number_26, YCoordinate=negative_2, ZCoordinate=addition_5)
construct_point_7 = ConstructPoint(XCoordinate=number_26, YCoordinate=number_22, ZCoordinate=addition_5)
negative_3 = Negative(Value=number_27)
line = Line(StartPoint=construct_point_6, EndPoint=construct_point_7)
revolution = Revolution(Curve=rectangle.Rectangle, Axis=line, Domain=number_27)
revolution_2 = Revolution(Curve=circle_3, Axis=line, Domain=number_27)
revolution_3 = Revolution(Curve=circle_4, Axis=line, Domain=number_27)
surface = Surface(revolution_2)
surface_2 = Surface(revolution_3)
degrees = Degrees(Radians=number_27)
cap_holes_3 = CapHoles(Brep=revolution)
cap_holes_4 = CapHoles(Brep=surface_2)
cap_holes_5 = CapHoles(Brep=surface)
negative_4 = Negative(Value=degrees)
solid_difference = SolidDifference(BrepsA=cap_holes_4, BrepsB=cap_holes_5)
integer_3 = Integer(integer_2)
number_28 = Number(negative_4)
construct_point_8 = ConstructPoint(XCoordinate=number_26, YCoordinate=negative_2, ZCoordinate=addition_5)
negative_5 = Negative(Value=number_27)
number_29 = Number(number_27)
number_30 = Number(number_23)
series = Series(Start=Slider(0, range=0..100), Step=Slider(1, range=0..1), Count=integer_3)
xz_plane = XZPlane(Origin=construct_point_8)
sine = Sine(Value=number_29)
cosine = Cosine(Value=number_29)
multiplication_2 = Multiplication(A=sine, B=number_30)
multiplication_3 = Multiplication(A=cosine, B=number_30)
negative_6 = Negative(Value=multiplication_2)
negative_7 = Negative(Value=multiplication_3)
vector_xyz = VectorXYZ(XComponent=negative_6, YComponent=0, ZComponent=negative_7)  # -> Vector, Length
solid_difference_2 = SolidDifference(BrepsA=solid_difference, BrepsB=cap_holes_3)
number_31 = Number(number_27)
negative_8 = Negative(Value=number_31)
multiplication_4 = Multiplication(A=negative_8, B=series)
cull_index = CullIndex(List=multiplication_4, Indices=Slider(0, range=0..100), Wrap=True)

number_32 = Number(ghpython_script_2.theta_eff)
multiplication_5 = Multiplication(A=explode_tree.Branch8, B=number_32)
degrees_2 = Degrees(Radians=multiplication_5)

# ----
# Position the control elements
# Create Rows
panel_9 = Panel("null")
panel_10 = Panel("""580
580
580
580
580
580""")
panel_11 = Panel("""40
40
40
40
40
40""")
create_label_15 = CreateLabel(LabelText="null", LabelSize=Slider(15, range=0..100), Justification=0)
create_label_16 = CreateLabel(LabelText=panel_9, LabelSize=Slider(15, range=0..100), Justification=0)
create_label_17 = CreateLabel(LabelText="Maximum Angle of Rotation (degrees)", LabelSize=Slider(18, range=0..100), Justification=0)
create_label_18 = CreateLabel(LabelText="Overall Tendon Pulled (mm)", LabelSize=Slider(18, range=0..100), Justification=0)
set_label_contents = SetLabelContents(LabelToModify=create_label_15, NewLabelContents=degrees_2)
multiplication_6 = Multiplication(A=explode_tree.Branch8, B=explode_tree.Branch6)
panel_12 = Panel("""0
1
2
3
4
5""")
set_label_contents_2 = SetLabelContents(LabelToModify=create_label_16, NewLabelContents=multiplication_6)
number_slider_5 = Slider(400, range=0..1000)
merge_3 = Merge(
    Data1=create_label_18,
    Data2=create_label_16,
    Data3=create_label_17,
    Data4=create_label_15,
    Data5=create_label_4,
    Data6=create_label_3)
value_list_4 = ValueList({"Left": 0, "Center": 1, "Right": 2}, selected="Left")
create_grid_3 = CreateGrid(
    UIElements=merge_3,
    Width=Slider(600, range=0..1000),
    Height=Slider(400, range=0..1000),
    RowDefinitions=panel_11,
    ColumnDefinitions=panel_10,
    ElementRow=panel_12,
    ElementRowSpan=1,
    ElementColumnSpan=1)
create_expander_3 = CreateExpander(UIElements=create_grid_3, Header="ESTIMATED PARAMETERS", Open=Toggle(True))
adjust_element_positioning_4 = AdjustElementPositioning(
    ElementsToAdjust=merge_3,
    Margin=Slider(0, range=0..1000),
    AbsolutePositioning=Toggle(False),
    Width=panel_10,
    Height=panel_11,
    HorizontalAlignment=value_list_4)

merge_4 = Merge(Data1=create_expander, Data2=create_expander_3)

# ----
# Position the control elements
# Create Rows
number_slider_6 = Slider(960, range=0..1000)
panel_13 = Panel("""500
400""")
panel_14 = Panel("""0
1""")
create_grid_4 = CreateGrid(
    UIElements=merge_4,
    Width=Slider(600, range=0..1000),
    Height=number_slider_6,
    RowDefinitions=panel_13,
    ElementRow=panel_14,
    ElementRowSpan=1,
    ElementColumnSpan=1)
value_list_5 = ValueList({"Left": 0, "Center": 1, "Right": 2}, selected="Left")
adjust_element_positioning_5 = AdjustElementPositioning(
    ElementsToAdjust=merge_4,
    Margin=Slider(0, range=0..1000),
    AbsolutePositioning=Toggle(False),
    Width=[Slider(600, range=0..1000), Slider(600, range=0..1000)],
    Height=[Slider(480, range=0..1000), Slider(300, range=0..1000)],
    HorizontalAlignment=value_list_5)

# ----
# Create Columns
panel_15 = Panel("""3*
2*
1*""")
panel_16 = Panel("""0
1
2""")
merge_5 = Merge(Data1=create_border, Data2=create_grid_4, Data3=create_expander_2)
panel_17 = Panel(merge_5)
create_grid_5 = CreateGrid(UIElements=merge_5, ColumnDefinitions=panel_15, ElementColumn=panel_16, ElementRowSpan=1, ElementColumnSpan=1)

# ----
# Create Tabs
panel_18 = Panel("Design Robot")
tabbed_view = TabbedView(TabNames=panel_18, TabTextSize=Slider(18, range=0..100), Tab0=flatten(create_grid_5))

# ----
# Create UI
boolean_toggle_3 = BooleanToggle(True)
launch_window = LaunchWindow(
    Show=boolean_toggle_3,
    Name="PRINTABLE APPLICATION SPECIFIC ENDOSCOPE TIP (PACET)",
    Width=get_screen_dimensions.Width,
    Height=get_screen_dimensions.Height,
    FontFamily="ARIAL",
    ChildStatus=0,
    EnableHorizScroll=False)
add_elements = AddElements(Window=launch_window, Elements=flatten(tabbed_view), DoVLChecking=True)  # -> AddedElements, ElementNames

number_33 = Number(number_2)
number_34 = Number(number)
construct_point_9 = ConstructPoint(XCoordinate=0, YCoordinate=0, ZCoordinate=number_34)
circle_5 = Circle(Plane=construct_point, Radius=number_33)
unit_z_4 = UnitZ(Factor=number_34)
circle_6 = Circle(Plane=construct_point_9, Radius=number_6)
circle_7 = Circle(Plane=construct_point_9, Radius=number_5)
unit_z_5 = UnitZ(Factor=number_7)
ruled_surface_2 = RuledSurface(CurveA=circle_6, CurveB=circle_7)
extrude_4 = Extrude(Base=ruled_surface_2, Direction=unit_z_5)

# ----
# ri
# Catheter Base Extrude Complete
number_35 = Number(number_3)

circle_8 = Circle(Plane=construct_point, Radius=number_35)
ruled_surface_3 = RuledSurface(CurveA=circle_8, CurveB=circle_5)
extrude_5 = Extrude(Base=ruled_surface_3, Direction=unit_z_4)
solid_union = SolidUnion(Breps=flatten([extrude_4, extrude_5]))

solid_difference_3 = SolidDifference(BrepsA=solid_union, BrepsB=cap_holes)
brep_2 = Brep(solid_difference_3)

set_label_contents_3 = SetLabelContents(LabelToModify=create_label, NewLabelContents=ghpython_script.out)

# ----
# hval
# cval
# ri
# Lb
# ri
# ro
# ro
# cval
# Stiff Segment
number_36 = Number(number_6)
number_37 = Number(number_5)
number_38 = Number(number_16)
subtraction_4 = Subtraction(A=number_37, B=number_36)
number_39 = Number(number_7)
number_40 = Number(number_9)
division_3 = Division(A=subtraction_4, B=Slider(2, range=0..10))
addition_6 = Addition(A=number_39, B=number_40, C=number_38)
addition_7 = Addition(A=division_3, B=number_36)
construct_point_10 = ConstructPoint(XCoordinate=addition_7, YCoordinate=0, ZCoordinate=addition_6)
number_41 = Number(number_36)
number_42 = Number(number_5)
construct_point_11 = ConstructPoint(XCoordinate=0, YCoordinate=0, ZCoordinate=addition_6)
circle_9 = Circle(Plane=construct_point_10, Radius=Slider(0.6, range=0..1))
polar_array_3 = PolarArray(Geometry=circle_9, Plane=PlaneXY(0, 0, 0), Count=Slider(1, range=0..10), Angle=6.283185307)  # -> Geometry, Transform
circle_10 = Circle(Plane=construct_point_11, Radius=number_41)
circle_11 = Circle(Plane=construct_point_11, Radius=number_42)
ruled_surface_4 = RuledSurface(CurveA=circle_10, CurveB=circle_11)

# ----
# hval
# n
# cval
# Patterned Notches and Stiff Segment
number_43 = Number(number_16)
number_44 = Number(number_11)
addition_8 = Addition(A=number_43, B=number_44)
integer_4 = Integer(explode_tree.Branch6)
unit_z_6 = UnitZ(Factor=addition_8)
subtraction_5 = Subtraction(A=integer_4, B=Slider(1, range=0..1))
linear_array = LinearArray(Geometry=brep, Direction=unit_z_6, Count=integer_4)  # -> Geometry, Transform

number_45 = Number(number_44)
unit_z_7 = UnitZ(Factor=number_45)
extrude_6 = Extrude(Base=polar_array_3.Geometry, Direction=unit_z_7)  # -> flatten(Extrusion)
extrude_7 = Extrude(Base=ruled_surface_4, Direction=unit_z_7)
cap_holes_6 = CapHoles(Brep=extrude_6)
solid_difference_4 = SolidDifference(BrepsA=extrude_7, BrepsB=cap_holes_6)
brep_3 = Brep(solid_difference_4)

number_46 = Number(number_45)
ghpython_script_3 = GhPythonScript(ro=number_22, Lb=number_20, a=number_19, theta_eff=number_27, r_eff=number_26, cval=number_46, n=integer_2)  # -> out, x0a, z0a, x0b, z0b, r_eff, theta_0, x0c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
# ---------- ghpython_script_3: Python ----------
"""Provides a scripting component.
    Inputs:
        x: The x script variable
        z: The z script variable
    Output:
        a: The a output variable"""

__author__ = "arjun"
__version__ = "2023.11.17"


import cmath

def calculate_argument(x1, z1, x2, z2):
    delta_x = x2 - x1
    delta_z = z2 - z1
    angle_radians = cmath.atan(delta_z/delta_x)
    angle_degrees = angle_radians*57.2958
    return angle_radians

def pointB(xa, za, rc, theta_eff):
    xb = xa + rc*(1-cmath.cos(theta_eff))
    zb = za + rc*cmath.sin(theta_eff)
    return xb, zb

def pointC(xa, za, rc, theta_eff, alpha):
    rhypo = cmath.sqrt(rc**2 + cval**2)
    xc = xa + (rc-rhypo*cmath.cos(theta_eff+alpha))
    coscomp = rhypo*(1-cmath.cos(theta_eff+alpha))
    zc = za + rhypo*cmath.sin(theta_eff+alpha)
    return xc, zc, rhypo, coscomp

def pointnC(xa, za, rc, theta_eff, alpha, n):
    rhypo = cmath.sqrt(rc**2 + cval**2)
    xc = xa + (rc-rhypo*cmath.cos(theta_eff+alpha))
    coscomp = rhypo*(1-cmath.cos(theta_eff+alpha))
    zc = za + rhypo*cmath.sin(theta_eff+alpha)
    return xc, zc, rhypo, coscomp


def alpha_cal(cval, rc):
    alpha =  cmath.atan(cval/rc)
    return alpha

#rc is radius of curvature with respect to the outer edge of the robot
x0a = -ro # orgin of the coordinate frame is set to the left-bottom most point of the first notched segment
z0a = a + Lb
rc = r_eff + ro
x0b, z0b = pointB(x0a, z0a, rc, theta_eff)
theta_0 = calculate_argument(x0a, z0a, x0b, z0b)
alpha0 = alpha_cal(cval, rc)
x0c, z0c, rhypo_0, coscomp = pointC(x0a, z0a, rc, theta_eff, alpha0)
rotation_angle=calculate_argument(x0a,z0a,x0c,z0c)
# ---------- end ghpython_script_3 ----------
construct_point_12 = ConstructPoint(XCoordinate=ghpython_script_3.x0c, YCoordinate=y_plane, ZCoordinate=ghpython_script_3.z0c)
construct_point_13 = ConstructPoint(XCoordinate=ghpython_script_3.r_eff, YCoordinate=y_plane, ZCoordinate=ghpython_script_3.z0a)
construct_point_14 = ConstructPoint(XCoordinate=ghpython_script_3.x0b, YCoordinate=y_plane, ZCoordinate=ghpython_script_3.z0b)
construct_point_15 = ConstructPoint(XCoordinate=ghpython_script_3.x0a, YCoordinate=y_plane, ZCoordinate=ghpython_script_3.z0a)
number_47 = Number(ghpython_script_3.z0c)
number_48 = Number(ghpython_script_3.x0a)
number_49 = Number(ghpython_script_3.z0a)
number_50 = Number(ghpython_script_3.x0c)
ghpython_script_4 = GhPythonScript(x=number_50, y=number_47, a=number_48, b=number_49, theta=number_28, n=integer_3)  # -> out, pointsout, a
# ---------- ghpython_script_4: Python ----------
__author__ = "arjun"
__version__ = "2023.11.21"

import rhinoscriptsyntax as rs
import math

def npointstest(x, y, a, b, theta, n):
    points = []
    zero_point = rs.AddPoint((a, b, 0))
    points.append(zero_point)  # Use append() to add to the list
    first_point = rs.AddPoint((x, y, 0))
    points.append(first_point)  # Use append() to add to the list
    distance_x=x-a
    distance_y=y-b
    print distance_x, distance_y 
    # Translate the point by (x, y)
    translation = rs.XformTranslation([distance_x, distance_y, 0])
    translated_point = rs.PointTransform(first_point, translation)
    
    # Create rotation transformation around the original point
    rotation_axis = [0, 0, 1]  # Z-axis for 2D rotation
    rotation = rs.XformRotation2(theta, rotation_axis, [x, y, 0])
    
    # Apply rotation to the translated point
    second_point = rs.PointTransform(translated_point, rotation)
    current_x, current_y = second_point[0], second_point[1]
    points.append(second_point)  # Use append() to add to the list
    
    print current_x, current_y 
    
    for i in range(n-3):       
        point = rs.AddPoint((current_x, current_y, 0))
        # Translate the point by (x, y)
        translation = rs.XformTranslation([distance_x, distance_y, 0])
        translated_point = rs.PointTransform(point, translation)
        
        # Create rotation transformation around the original point
        rotation_axis = [0, 0, 1]  # Z-axis for 2D rotation
        rotation = rs.XformRotation2(theta, rotation_axis, [x, y, 0])
        
        # Apply rotation to the translated point
        transformed_point = rs.PointTransform(translated_point, rotation)
        
        points.append(transformed_point)  # Use append() to add to the list
        current_x = transformed_point[0]
        current_y = transformed_point[1]
        #Update current_x and current_y for the next iteration
        #current_x, current_y, current_z  = rs.PointCoordinates(transformed_point)
        

    return points

pointsout= npointstest(x, y,a, b, theta, n)
# ---------- end ghpython_script_4 ----------
rotate = Rotate(Geometry=brep_3, Angle=negative_5, Plane=xz_plane)  # -> Geometry, Transform
cull_index_2 = CullIndex(List=ghpython_script_4.pointsout, Indices=Slider(0, range=0..100), Wrap=True)
move = Move(Geometry=rotate.Geometry, Motion=vector_xyz.Vector)  # -> Geometry, Transform
deconstruct = Deconstruct(Point=cull_index_2)  # -> XComponent, YComponent, ZComponent
solid_union_2 = SolidUnion(Breps=[solid_difference_2, move.Geometry])
construct_point_16 = ConstructPoint(XCoordinate=deconstruct.XComponent, YCoordinate=Slider(0, range=0..100), ZCoordinate=deconstruct.YComponent)
vector_2pt = Vector2Pt(PointA=construct_point_15, PointB=construct_point_16, Unitize=False)  # -> Vector, Length
xz_plane_2 = XZPlane(Origin=construct_point_16)
move_2 = Move(Geometry=solid_union_2, Motion=vector_2pt.Vector)  # -> Geometry, Transform
cull_index_3 = CullIndex(List=xz_plane_2, Indices=Slider(1, range=0..100), Wrap=True)
rotate_2 = Rotate(Geometry=move_2.Geometry, Angle=cull_index, Plane=xz_plane_2)  # -> Geometry, Transform

linear_array_2 = LinearArray(Geometry=brep_3, Direction=unit_z_6, Count=subtraction_5)  # -> Geometry, Transform
solid_union_3 = SolidUnion(Breps=[linear_array.Geometry, linear_array_2.Geometry])

# ----
# cval
# Lb
# ri
# hval
# ro
# cval
# Ri
# Ro
# Top Segment
number_51 = Number(number_43)
number_52 = Number(number_42)
number_53 = Number(number_41)
number_54 = Number(number_45)
multiplication_7 = Multiplication(A=number_51, B=integer_4)
subtraction_6 = Subtraction(A=number_52, B=number_53)
multiplication_8 = Multiplication(A=number_54, B=subtraction_5)
number_55 = Number(number_44)
number_56 = Number(number_12)
division_4 = Division(A=subtraction_6, B=Slider(2, range=0..10))
addition_9 = Addition(A=number_55, B=number_56, C=multiplication_7, D=multiplication_8)
addition_10 = Addition(A=division_4, B=number_53)
construct_point_17 = ConstructPoint(XCoordinate=addition_10, YCoordinate=0, ZCoordinate=addition_9)
number_57 = Number(number_6)
number_58 = Number(number_42)
construct_point_18 = ConstructPoint(XCoordinate=0, YCoordinate=0, ZCoordinate=addition_9)
circle_12 = Circle(Plane=construct_point_17, Radius=Slider(0.6, range=0..1))
polar_array_4 = PolarArray(Geometry=circle_12, Plane=PlaneXY(0, 0, 0), Count=Slider(1, range=0..10), Angle=6.283185307)  # -> Geometry, Transform
unit_z_8 = UnitZ(Factor=number_54)
circle_13 = Circle(Plane=construct_point_18, Radius=number_57)
circle_14 = Circle(Plane=construct_point_18, Radius=number_58)
extrude_8 = Extrude(Base=polar_array_4.Geometry, Direction=unit_z_8)  # -> flatten(Extrusion)
ruled_surface_5 = RuledSurface(CurveA=circle_13, CurveB=circle_14)
extrude_9 = Extrude(Base=ruled_surface_5, Direction=unit_z_8)
cap_holes_7 = CapHoles(Brep=extrude_8)
solid_difference_5 = SolidDifference(BrepsA=extrude_9, BrepsB=cap_holes_7)

# ----
# Final Bend
brep_4 = Brep(solid_union_2)
brep_5 = Brep(brep_2)
brep_6 = Brep(rotate_2.Geometry)
solid_union_4 = SolidUnion(Breps=[brep_5, brep_4, brep_6])
brep_7 = Brep(solid_union_4)

# ----
# Final Unbend
brep_8 = Brep(solid_union_3)
brep_9 = Brep(brep_2)
brep_10 = Brep(solid_difference_5)
solid_union_5 = SolidUnion(Breps=[brep_9, brep_8, brep_10])
brep_11 = Brep(solid_union_5)

ghpython_script_5 = GhPythonScript(BREPA=brep_11, BREPB=brep_7, STRING_PULL=number_18)  # -> out, BREP_OUT
# ---------- ghpython_script_5: Python ----------
__author__ = "arjun"
__version__ = "2023.11.22"

import rhinoscriptsyntax as rs

def brep_final(BREPA, BREPB, STRING_PULL):
    if STRING_PULL==0:
        BREP_OUT = BREPA
    else:
        BREP_OUT = BREPB
    return BREP_OUT
    

BREP_OUT = brep_final(BREPA, BREPB, STRING_PULL)
# ---------- end ghpython_script_5 ----------
brep_12 = Brep(ghpython_script_5.BREP_OUT)

brep_13 = Brep(flatten(brep_12))
set_3d_view = Set3DView(_3DView=create_3d_view, MeshToDisplay=brep_13, MeshColors=value_listener_2.Values)
