# Grasshopper definition Parametric Continuum Robot.gh (Grasshopper 1.0.7)
# plug-ins: Human UI

# ----
# Inner Radius i/p (Ri)
# Tip Outer Radius i/p (Ro)
# Base Outer Radius i/p (Rb)
# Base Height (Lb)
# Catheter Height (L)
# Notch Overcut (Lw)
# Notch Length (Ln)
# Minimum Tip End Thickness (Le)
ri = Slider(4, range=1..19)
ro = Slider(8, range=2..20)
lb = Slider(5, range=5..20)
rb = Slider(20, range=2..30)
L = Slider(100, range=20..400)
lw = Slider(8, range=0..30)
ln = Slider(12, range=0..40)
le = Slider(3, range=2..10)

xy_plane = XYPlane(Origin=Point(0, 0, 0))
cylinder_parameters = Slider(68, range=0..100)
cylinder_parameters_2 = Slider(84, range=0..100)
radius = Slider(34, range=0..100)
radius_2 = Slider(1, range=0..3)
cylinder = Cylinder(Base=xy_plane, Radius=cylinder_parameters, Length=cylinder_parameters_2)
create_label = CreateLabel(LabelText="EDIT THE PARAMETERS BELOW:", LabelSize=radius, Justification=radius_2)
create_3d_view = Create3DView(
    MeshToDisplay=cylinder,
    MeshColors=RGB(255, 0, 0),
    ViewWidth=Slider(920, range=0..1920),
    ViewHeight=Slider(920, range=0..1080))
create_label_2 = CreateLabel(LabelText="NA", LabelSize=Slider(20, range=0..100), Justification=0)
create_label_3 = CreateLabel(LabelText="NA", LabelSize=Slider(20, range=0..100), Justification=0)
create_label_4 = CreateLabel(LabelText="Theoretical Maximum Bend per Notch (in Degrees):", LabelSize=Slider(20, range=0..100), Justification=0)
create_label_5 = CreateLabel(LabelText="Theoretical Maximum Bending Angle (in Degrees):", LabelSize=Slider(20, range=0..100), Justification=0)
create_slider = CreateSlider(
    Slider=[ri, ro, rb, lb, L, lw, ln, le],
    ShowBounds=False,
    ShowTicks=False,
    ShowTooltip=False,
    ShowValLabel=True,
    showLabel=True)
create_color_picker = CreateColorPicker(DefaultColor=ColourSwatch(SwatchColor=RGB(173, 173, 173)))

# ----
# Inner Radius i/p (Ri)
# Tip Outer Radius i/p (Ro)
# Base Outer Radius i/p (Rb)
# Base Height (Lb)
# Catheter Height (L)
# Notch Overcut (Lw)
# Notch Length (Ln)
# Minimum Tip End Thickness (Le)
ri_2 = Slider(8, range=1..15)
ro_2 = Slider(12, range=2..20)
rb_2 = Slider(20, range=2..30)
lb_2 = Slider(5, range=5..20)
lw_2 = Slider(8, range=0..15)
L_2 = Slider(100, range=20..200)
ln_2 = Slider(6, range=1..30)
le_2 = Slider(3, range=2..10)

xy_plane_2 = XYPlane(Origin=Point(0, 0, 0))
cylinder_parameters_3 = Slider(68, range=0..100)
cylinder_parameters_4 = Slider(84, range=0..100)
radius_3 = Slider(34, range=0..100)
radius_4 = Slider(1, range=0..3)
cylinder_2 = Cylinder(Base=xy_plane_2, Radius=cylinder_parameters_3, Length=cylinder_parameters_4)
create_label_6 = CreateLabel(LabelText="EDIT THE PARAMETERS BELOW:", LabelSize=radius_3, Justification=radius_4)
create_3d_view_2 = Create3DView(
    MeshToDisplay=cylinder_2,
    MeshColors=RGB(255, 0, 0),
    ViewWidth=Slider(920, range=0..1920),
    ViewHeight=Slider(920, range=0..1080))
create_label_7 = CreateLabel(LabelText="NA", LabelSize=Slider(20, range=0..100), Justification=0)
create_label_8 = CreateLabel(LabelText="NA", LabelSize=Slider(20, range=0..100), Justification=0)
create_label_9 = CreateLabel(LabelText="Theoretical Maximum Bend per Notch (in Degrees):", LabelSize=Slider(20, range=0..100), Justification=0)
create_label_10 = CreateLabel(LabelText="Theoretical Maximum Bending Angle (in Degrees):", LabelSize=Slider(20, range=0..100), Justification=0)
create_slider_2 = CreateSlider(
    Slider=[ri_2, ro_2, rb_2, lb_2, L_2, lw_2, ln_2, le_2],
    ShowBounds=False,
    ShowTicks=False,
    ShowTooltip=False,
    ShowValLabel=True,
    showLabel=True)
create_color_picker_2 = CreateColorPicker(DefaultColor=ColourSwatch(SwatchColor=RGB(173, 173, 173)))

# ----
# Add border
number_slider = Slider(1, range=0..10)
create_border = CreateBorder(
    UIElement=create_3d_view,
    BorderThickness=number_slider,
    BorderColor=ColourSwatch(SwatchColor=RGB(120, 120, 120)),
    CornerRadius=Slider(30, range=0..100))

# ----
# Add border
number_slider_2 = Slider(1, range=0..10)
create_border_2 = CreateBorder(
    UIElement=create_3d_view_2,
    BorderThickness=number_slider_2,
    BorderColor=ColourSwatch(SwatchColor=RGB(120, 120, 120)),
    CornerRadius=Slider(30, range=0..100))

# ----
# Position the 3D model
boolean_toggle = BooleanToggle(True)
value_list = ValueList({"Left": 0, "Center": 1, "Right": 2}, selected="Center")
adjust_element_positioning = AdjustElementPositioning(
    ElementsToAdjust=create_border,
    Margin=Slider(10, range=0..100),
    AbsolutePositioning=boolean_toggle,
    Width=Slider(920, range=0..1280),
    Height=Slider(920, range=0..1080),
    HorizontalAlignment=value_list)

# ----
# Position the 3D model
boolean_toggle_2 = BooleanToggle(True)
value_list_2 = ValueList({"Left": 0, "Center": 1, "Right": 2}, selected="Center")
adjust_element_positioning_2 = AdjustElementPositioning(
    ElementsToAdjust=create_border_2,
    Margin=Slider(10, range=0..100),
    AbsolutePositioning=boolean_toggle_2,
    Width=Slider(920, range=0..1280),
    Height=Slider(920, range=0..1080),
    HorizontalAlignment=value_list_2)

# ----
# Position the control elements
# Create Rows
panel = Panel("CONSTRAINTS:")
create_label_11 = CreateLabel(LabelText=panel, LabelSize=Slider(30, range=0..100), Justification=0)
create_label_12 = CreateLabel(LabelText="1mm < Inner Radius(Ri) < 19mm", LabelSize=Slider(14, range=0..100), Justification=0)
create_label_13 = CreateLabel(LabelText="Ri + 1mm <= Outer Radius(Ro) <= 20mm", LabelSize=Slider(14, range=0..100), Justification=0)
create_label_14 = CreateLabel(LabelText=" Ro <= Base Radius(Rb) <= 30mm", LabelSize=Slider(14, range=0..100), Justification=0)
create_label_15 = CreateLabel(LabelText=" 5mm <= Base Length(Lb) <= 20mm", LabelSize=Slider(14, range=0..100), Justification=0)
create_label_16 = CreateLabel(LabelText="20mm <= Tip Length(L) <= 400mm", LabelSize=Slider(14, range=0..100), Justification=0)
create_label_17 = CreateLabel(LabelText="0 <= Notch Width(Lw) <= Ro + Ri", LabelSize=Slider(14, range=0..100), Justification=0)
create_label_18 = CreateLabel(LabelText="1mm <= Notch Length(Ln) <= 2Lw", LabelSize=Slider(14, range=0..100), Justification=0)
create_label_19 = CreateLabel(LabelText="1mm <= Tip End Length(Le) <= 10mm", LabelSize=Slider(14, range=0..100), Justification=0)
merge = Merge(
    Data1=create_label_11,
    Data2=create_label_12,
    Data3=create_label_13,
    Data4=create_label_14,
    Data5=create_label_15,
    Data6=create_label_16,
    Data7=create_label_17,
    Data8=create_label_18,
    Data9=create_label_19)
panel_2 = Panel("""80
60
60
60
60
60
60
60
60""")
value_list_3 = ValueList({"Left": 0, "Center": 1, "Right": 2}, selected="Left")
panel_3 = Panel("""0
1
2
3
4
5
6
7
8""")
create_grid = CreateGrid(
    UIElements=merge,
    Width=Slider(350, range=0..1000),
    Height=Slider(920, range=0..1000),
    RowDefinitions=panel_2,
    ElementRow=panel_3,
    ElementRowSpan=1,
    ElementColumnSpan=1)
adjust_element_positioning_3 = AdjustElementPositioning(
    ElementsToAdjust=merge,
    Margin=Slider(10, range=0..1000),
    AbsolutePositioning=Toggle(True),
    Width=Slider(350, range=0..1000),
    Height=Slider(60, range=0..1000),
    HorizontalAlignment=value_list_3)

# ----
# Position the control elements
# Create Rows
panel_4 = Panel("CONSTRAINTS:")
create_label_20 = CreateLabel(LabelText=panel_4, LabelSize=Slider(30, range=0..100), Justification=0)
create_label_21 = CreateLabel(LabelText="1mm < Inner Radius(Ri) < 19mm", LabelSize=Slider(14, range=0..100), Justification=0)
create_label_22 = CreateLabel(LabelText="Ri + 1mm <= Outer Radius(Ro) <= 20mm", LabelSize=Slider(14, range=0..100), Justification=0)
create_label_23 = CreateLabel(LabelText=" Ro <= Base Radius(Rb) <= 30mm", LabelSize=Slider(14, range=0..100), Justification=0)
create_label_24 = CreateLabel(LabelText=" 5mm <= Base Length(Lb) <= 20mm", LabelSize=Slider(14, range=0..100), Justification=0)
create_label_25 = CreateLabel(LabelText="20mm <= Tip Length(L) <= 400mm", LabelSize=Slider(14, range=0..100), Justification=0)
create_label_26 = CreateLabel(LabelText="0 <= Notch Width(Lw) <= Ro + Ri", LabelSize=Slider(14, range=0..100), Justification=0)
create_label_27 = CreateLabel(LabelText="1mm <= Notch Length(Ln) <= 2Rw", LabelSize=Slider(14, range=0..100), Justification=0)
create_label_28 = CreateLabel(LabelText="1mm <= Tip End Length(Le) <= 10mm", LabelSize=Slider(14, range=0..100), Justification=0)
merge_2 = Merge(
    Data1=create_label_20,
    Data2=create_label_21,
    Data3=create_label_22,
    Data4=create_label_23,
    Data5=create_label_24,
    Data6=create_label_25,
    Data7=create_label_26,
    Data8=create_label_27,
    Data9=create_label_28)
panel_5 = Panel("""80
60
60
60
60
60
60
60
60""")
value_list_4 = ValueList({"Left": 0, "Center": 1, "Right": 2}, selected="Left")
panel_6 = Panel("""0
1
2
3
4
5
6
7
8""")
create_grid_2 = CreateGrid(
    UIElements=merge_2,
    Width=Slider(350, range=0..1000),
    Height=Slider(920, range=0..1000),
    RowDefinitions=panel_5,
    ElementRow=panel_6,
    ElementRowSpan=1,
    ElementColumnSpan=1)
adjust_element_positioning_4 = AdjustElementPositioning(
    ElementsToAdjust=merge_2,
    Margin=Slider(10, range=0..1000),
    AbsolutePositioning=Toggle(True),
    Width=Slider(350, range=0..1000),
    Height=Slider(60, range=0..1000),
    HorizontalAlignment=value_list_4)

# ----
# Position the control elements
# Create Rows
panel_7 = Panel("1mm < Inner Radius(Ri) < 19mm")
create_label_29 = CreateLabel(LabelText="CONSTRAINTS:", LabelSize=Slider(30, range=0..100), Justification=0)
create_label_30 = CreateLabel(LabelText=panel_7, LabelSize=Slider(14, range=0..100), Justification=0)
create_label_31 = CreateLabel(LabelText="Ri + 1mm <= Outer Radius(Ro) <= 20mm", LabelSize=Slider(14, range=0..100), Justification=0)
create_label_32 = CreateLabel(LabelText=" Ro <= Base Radius(Rb) <= 30mm", LabelSize=Slider(14, range=0..100), Justification=0)
create_label_33 = CreateLabel(LabelText=" 5mm <= Base Length(Lb) <= 20mm", LabelSize=Slider(14, range=0..100), Justification=0)
create_label_34 = CreateLabel(LabelText="20mm <= Tip Length(L) <= 400mm", LabelSize=Slider(14, range=0..100), Justification=0)
create_label_35 = CreateLabel(LabelText="0 <= Notch Width(Lw) <= Ro + Ri", LabelSize=Slider(14, range=0..100), Justification=0)
create_label_36 = CreateLabel(LabelText="1mm <= Notch Length(Ln) <= 2Rw", LabelSize=Slider(14, range=0..100), Justification=0)
create_label_37 = CreateLabel(LabelText="1mm <= Tip End Length(Le) <= 10mm", LabelSize=Slider(14, range=0..100), Justification=0)
merge_3 = Merge(
    Data1=create_label_29,
    Data2=create_label_30,
    Data3=create_label_31,
    Data4=create_label_32,
    Data5=create_label_33,
    Data6=create_label_34,
    Data7=create_label_35,
    Data8=create_label_36,
    Data9=create_label_37)
panel_8 = Panel("""80
60
60
60
60
60
60
60
60""")
value_list_5 = ValueList({"Left": 0, "Center": 1, "Right": 2}, selected="Left")
panel_9 = Panel("""0
1
2
3
4
5
6
7
8""")
create_grid_3 = CreateGrid(
    UIElements=merge_3,
    Width=Slider(350, range=0..1000),
    Height=Slider(920, range=0..1000),
    RowDefinitions=panel_8,
    ElementRow=panel_9,
    ElementRowSpan=1,
    ElementColumnSpan=1)
adjust_element_positioning_5 = AdjustElementPositioning(
    ElementsToAdjust=merge_3,
    Margin=Slider(10, range=0..1000),
    AbsolutePositioning=Toggle(True),
    Width=Slider(350, range=0..1000),
    Height=Slider(60, range=0..1000),
    HorizontalAlignment=value_list_5)

# ----
# Birectional Overnotched
# Add border
# Position the 3D model
# Inner Radius i/p (Ri)
# Position the control elements
# Tip Outer Radius i/p (Ro)
# Base Outer Radius i/p (Rb)
# Base Height (Lb)
# Create Rows
# Create Columns
# Catheter Height (L)
# Notch Overcut (Lw)
# Notch Length (Ln)
# Minimum Tip End Thickness (Le)
# Update Values
# Catheter Tip/Base Inner Radius:
# Minimum value set to be 1 mm
# Can be incremented by 0.1 mm
# Maximum value set to be 15.0 mm
# Start value regulated
# Ri
# Ri
# Step 1: Catheter Tip/Base Inner Radius
# Ro
# Start Value Regulated
# Ri
# Ro
# Catheter Tip Outer Radius:
# Minimum value set to be 1 mm more than inner radius.
# Can be incremented by 0.1 mm
# Maximum value set to be 20.0 mm
# Data Merge Order:
# 0. Ri
# 1. Ro
# 2. Rb
# 
# 3. Lb
# 4. L
# 
# 5. w
# 6. Lw
# 7. Ln
# 
# 8. N
# 9. Lef
# 
# 10. a
# 11. phi
# Ri
# Step 2: Catheter Tip Outer Radius
# Ro
# Ro
# Start Value Regulated
# Rb
# Rb
# Rb
# Catheter Tip Outer Radius:
# Minimum value to be 10 mm more than outer radius of tip.
# Can be incremented by 0.1 mm
# Maximum value set to be 30.0 mm
# Step 3: Catheter Base Outer Radius
# Lb
# L
# Base Extrude
# Rb
# Lb
# Ri
# Catheter Extrude
# Ro
# w
# L
# Lw
# Ln
# Ro
# Lw
# Ln
# N
# Step 4: Catheter Build
# N
# Lef
# a
# Notch Overcut (Lw)
# phi
# Wall Width (w)
# Ro
# Lw
# Ri
# Notch Overcut  (Lw) Compute:
# Minimum Lw set to be 0.
# Maximum Lw set to be Ri+Ro.
# This block sets Lw within permissible ranges dynamically
# End Value Regulated
# Step 5: Notch Overcut (Lw)
# Notch Length (Ln)
# Ln
# Lw
# End Value Regulated
# Notch Length Compute:
# Minimum Ln set to be 1 mm by slider.
# Maximum will be Ro.
# This block sets Ln within permissible ranges dynamically
# Step 6: Notch Length Calculate (Ln)
# L
# Number of notches (N)
# Ln
# Le
# No. of Notch Calculator:
# N has to be integer.
# N = (L-2Le+Ln)/(2Ln)
# Step 7: Number of Notches (N)
# Step 8: Tip End Thickness
# Compensation
# L
# Lef
# Le
# As N is integer, to adjust for extra length, the thickness of both ends of the catheter is increased by half of residual length to keep catheter height fixed.
# Lef= Le + ((L-(2N-1)Ln)/2)
# Angle per Notch (a)
# Max Angle per Notch (a) = 2sininv(Ln/2(Ro+Lw))
# Step 9: Angle per Notch Calculation
# Step 10: Total Bend Angle Calculation
xy_plane_3 = XYPlane(Origin=Point(0, 0, 0))
cylinder_parameters_5 = Slider(68, range=0..100)
cylinder_parameters_6 = Slider(84, range=0..100)
radius_5 = Slider(34, range=0..100)
radius_6 = Slider(1, range=0..3)
ri_3 = Slider(8, range=1..19)
ro_3 = Slider(12, range=2..20)
lb_3 = Slider(5, range=5..20)
rb_3 = Slider(20, range=2..30)
L_3 = Slider(200, range=20..400)
lw_3 = Slider(14, range=0..15)
ln_3 = Slider(12, range=1..30)
le_3 = Slider(3, range=2..10)
cylinder_3 = Cylinder(Base=xy_plane_3, Radius=cylinder_parameters_5, Length=cylinder_parameters_6)
create_label_38 = CreateLabel(LabelText="EDIT THE PARAMETERS BELOW:", LabelSize=radius_5, Justification=radius_6)
create_3d_view_3 = Create3DView(
    MeshToDisplay=cylinder_3,
    MeshColors=RGB(255, 0, 0),
    ViewWidth=Slider(920, range=0..1920),
    ViewHeight=Slider(920, range=0..1080))
create_label_39 = CreateLabel(LabelText="NA", LabelSize=Slider(20, range=0..100), Justification=0)
create_label_40 = CreateLabel(LabelText="NA", LabelSize=Slider(20, range=0..100), Justification=0)
create_label_41 = CreateLabel(LabelText="Theoretical Maximum Bend per Notch (in Degrees):", LabelSize=Slider(20, range=0..100), Justification=0)
create_label_42 = CreateLabel(LabelText="Theoretical Maximum Bending Angle (in Degrees):", LabelSize=Slider(20, range=0..100), Justification=0)
create_slider_3 = CreateSlider(
    Slider=[ri_3, ro_3, rb_3, lb_3, L_3, lw_3, ln_3, le_3],
    ShowBounds=False,
    ShowTicks=False,
    ShowTooltip=False,
    ShowValLabel=True,
    showLabel=True)
create_color_picker_3 = CreateColorPicker(DefaultColor=ColourSwatch(SwatchColor=RGB(173, 173, 173)))
construct_point = ConstructPoint(XCoordinate=0, YCoordinate=0, ZCoordinate=0)
inner_radius_min = Slider(1, range=1..10)
minimum_resolution = Slider(10, range=0..100)
merge_4 = Merge(
    Data1=create_label_38,
    Data2=create_slider_3,
    Data3=create_color_picker_3,
    Data4=create_label_41,
    Data5=create_label_39,
    Data6=create_label_42,
    Data7=create_label_40)
minimum_resolution_2 = Slider(10, range=0..100)
minimum_resolution_3 = Slider(10, range=0..100)
min_step = Slider(0.1, range=0..1)
min_step_2 = Slider(0.1, range=0..1)
min_step_3 = Slider(0.1, range=0..1)
value_listener = ValueListener(Elements=create_color_picker_3, SomeProperty=True)  # -> Values, Indices
value_listener_2 = ValueListener(Elements=create_slider_3, SomeProperty=True)  # -> Values, Indices
create_border_3 = CreateBorder(
    UIElement=create_3d_view_3,
    BorderThickness=Slider(1, range=0..10),
    BorderColor=ColourSwatch(SwatchColor=RGB(120, 120, 120)),
    CornerRadius=Slider(30, range=0..100))
value_list_6 = ValueList({"Left": 0, "Center": 1, "Right": 2}, selected="Center")
explode_tree = ExplodeTree(Data=value_listener_2.Values)  # -> Branch0, Branch1, Branch2, Branch3, Branch4, Branch5, Branch6, Branch7
number = Number(explode_tree.Branch3)
number_2 = Number(explode_tree.Branch4)
number_3 = Number(explode_tree.Branch0)
number_4 = Number(explode_tree.Branch1)
number_5 = Number(explode_tree.Branch5)
number_6 = Number(explode_tree.Branch6)
number_7 = Number(explode_tree.Branch7)
construct_point_2 = ConstructPoint(XCoordinate=0, YCoordinate=0, ZCoordinate=number)
number_8 = Number(explode_tree.Branch2)
unit_z = UnitZ(Factor=number)
subtraction = Subtraction(A=number_3, B=inner_radius_min)
multiplication = Multiplication(A=minimum_resolution, B=number_3)
unit_z_2 = UnitZ(Factor=number_2)
addition = Addition(A=number, B=number_2)
number_9 = Number(number_7)
number_10 = Number(number_2)
multiplication_2 = Multiplication(A=Slider(2, range=0..10), B=number_7)
multiplication_3 = Multiplication(A=number_9, B=Slider(2, range=0..10))
unit_z_3 = UnitZ(Factor=addition)
multiplication_4 = Multiplication(A=subtraction, B=minimum_resolution)
number_11 = Number(number_10)
subtraction_2 = Subtraction(A=number_10, B=multiplication_2)
subtraction_3 = Subtraction(A=multiplication, B=minimum_resolution)
unit_z_4 = UnitZ(Factor=number)
addition_2 = Addition(A=multiplication_4, B=Slider(1, range=0..1))
number_12 = Number(number_7)
series = Series(Start=inner_radius_min, Step=min_step_2, Count=addition_2)
list_item = ListItem(List=series, Index=subtraction_3, Wrap=True)
number_13 = Number(list_item)
number_14 = Number(number_13)
number_15 = Number(number_13)
number_16 = Number(number_14)
circle = Circle(Plane=construct_point_2, Radius=number_14)
circle_2 = Circle(Plane=construct_point, Radius=number_14)
subtraction_4 = Subtraction(A=number_4, B=number_15)
subtraction_5 = Subtraction(A=number_4, B=number_15)
multiplication_5 = Multiplication(A=subtraction_5, B=minimum_resolution_3)
multiplication_6 = Multiplication(A=subtraction_4, B=minimum_resolution_3)
addition_3 = Addition(A=multiplication_5, B=Slider(1, range=0..1))
series_2 = Series(Start=number_15, Step=min_step, Count=addition_3)
list_item_2 = ListItem(List=series_2, Index=multiplication_6, Wrap=True)
number_17 = Number(list_item_2)
number_18 = Number(number_17)
number_19 = Number(number_17)
number_20 = Number(number_19)
number_21 = Number(number_18)
subtraction_6 = Subtraction(A=number_18, B=number_14)
division = Division(A=subtraction_6, B=Slider(2, range=0..10))
addition_4 = Addition(A=number_21, B=number_16)
subtraction_7 = Subtraction(A=number_8, B=number_19)
circle_3 = Circle(Plane=construct_point_2, Radius=number_18)
addition_5 = Addition(A=division, B=number_14)
construct_point_3 = ConstructPoint(XCoordinate=addition_5, YCoordinate=0, ZCoordinate=0)
ruled_surface = RuledSurface(CurveA=circle, CurveB=circle_3)
subtraction_8 = Subtraction(A=number_8, B=number_19)
subtraction_9 = Subtraction(A=addition_4, B=number_5)
construct_domain = ConstructDomain(DomainStart=number_5, DomainEnd=addition_4)
circle_4 = Circle(Plane=construct_point_3, Radius=Slider(1, range=0..1))
multiplication_7 = Multiplication(A=subtraction_8, B=minimum_resolution_2)
multiplication_8 = Multiplication(A=minimum_resolution_2, B=subtraction_7)
multiplication_9 = Multiplication(A=subtraction_9, B=Slider(10, range=0..10))
extrude = Extrude(Base=ruled_surface, Direction=unit_z_2)
polar_array = PolarArray(Geometry=circle_4, Plane=PlaneXY(0, 0, 0), Count=Slider(2, range=0..10), Angle=6.283185307)  # -> Geometry, Transform
addition_6 = Addition(A=multiplication_7, B=Slider(1, range=0..1))
addition_7 = Addition(A=multiplication_9, B=Slider(1, range=0..1))
series_3 = Series(Start=number_19, Step=min_step_3, Count=addition_6)
extrude_2 = Extrude(Base=polar_array.Geometry, Direction=unit_z_3)  # -> flatten(Extrusion)
range = Range(Domain=construct_domain, Steps=addition_7)
list_item_3 = ListItem(List=series_3, Index=multiplication_8, Wrap=True)
subtraction_10 = Subtraction(A=number_21, B=number_16)
number_22 = Number(list_item_3)
number_23 = Number(number_22)
subtraction_11 = Subtraction(A=number_23, B=number_18)
division_2 = Division(A=subtraction_11, B=Slider(2, range=0..10))
addition_8 = Addition(A=number_18, B=division_2)
circle_5 = Circle(Plane=construct_point, Radius=number_23)
construct_point_4 = ConstructPoint(XCoordinate=addition_8, YCoordinate=0, ZCoordinate=0)
ruled_surface_2 = RuledSurface(CurveA=circle_2, CurveB=circle_5)
circle_6 = Circle(Plane=construct_point_4, Radius=Slider(3.4, range=0..3.4))
polar_array_2 = PolarArray(Geometry=circle_6, Plane=PlaneXY(0, 0, 0), Count=Slider(4, range=0..10), Angle=6.283185307)  # -> Geometry, Transform
extrude_3 = Extrude(Base=ruled_surface_2, Direction=unit_z)
extrude_4 = Extrude(Base=polar_array_2.Geometry, Direction=unit_z_4)  # -> flatten(Extrusion)
solid_union = SolidUnion(Breps=flatten([extrude, extrude_3]))
cap_holes = CapHoles(Brep=[extrude_2, extrude_4])
list_item_4 = ListItem(List=range, Index=Slider(0, range=0..100), Wrap=True)
solid_difference = SolidDifference(BrepsA=solid_union, BrepsB=cap_holes)
number_24 = Number(list_item_4)
number_25 = Number(number_24)
number_26 = Number(number_25)
addition_9 = Addition(A=number_26, B=number_20)
multiplication_10 = Multiplication(A=Slider(2, range=0..10), B=addition_9)
multiplication_11 = Multiplication(A=number_25, B=Slider(2, range=0..10))
construct_domain_2 = ConstructDomain(DomainStart=number_6, DomainEnd=multiplication_11)
subtraction_12 = Subtraction(A=multiplication_11, B=number_6)
multiplication_12 = Multiplication(A=subtraction_12, B=Slider(10, range=0..10))
addition_10 = Addition(A=multiplication_12, B=Slider(1, range=0..1))
range_2 = Range(Domain=construct_domain_2, Steps=addition_10)
list_item_5 = ListItem(List=range_2, Index=Slider(0, range=0..100), Wrap=True)
number_27 = Number(list_item_5)
number_28 = Number(number_27)
number_29 = Number(number_28)
number_30 = Number(number_29)
division_3 = Division(A=number_30, B=multiplication_10)
arcsine = ArcSine(Value=division_3)
degrees = Degrees(Radians=arcsine)
multiplication_13 = Multiplication(A=Slider(2, range=0..10), B=degrees)
addition_11 = Addition(A=subtraction_2, B=number_28)
number_31 = Number(multiplication_13)
number_32 = Number(number_31)
multiplication_14 = Multiplication(A=Slider(2, range=0..10), B=number_28)
integer_division = IntegerDivision(A=addition_11, B=multiplication_14)
adjust_element_positioning_6 = AdjustElementPositioning(
    ElementsToAdjust=create_border_3,
    Margin=Slider(10, range=0..100),
    AbsolutePositioning=Toggle(True),
    Width=Slider(920, range=0..1280),
    Height=Slider(920, range=0..1080),
    HorizontalAlignment=value_list_6)
number_33 = Number(subtraction_10)
# N
integer = Integer(integer_division)
integer_2 = Integer(integer)
multiplication_15 = Multiplication(A=integer_2, B=Slider(2, range=0..10))
subtraction_13 = Subtraction(A=multiplication_15, B=Slider(1, range=0..1))
multiplication_16 = Multiplication(A=number_29, B=subtraction_13)
integer_3 = Integer(integer_2)
addition_12 = Addition(A=multiplication_16, B=multiplication_3)
subtraction_14 = Subtraction(A=number_11, B=addition_12)
multiplication_17 = Multiplication(A=number_32, B=integer_3)
division_4 = Division(A=subtraction_14, B=Slider(2, range=0..10))
addition_13 = Addition(A=division_4, B=number_12)
number_34 = Number(addition_13)
number_35 = Number(multiplication_17)
panel_10 = Panel("""75
60
60
60
60
60
60
60
60
80
60
60
60
60""")
panel_11 = Panel("""0
1
2
3
4
5
6
7
8
9
10
11
12
13""")
create_grid_4 = CreateGrid(
    UIElements=merge_4,
    Width=Slider(650, range=0..1000),
    Height=Slider(920, range=0..1000),
    RowDefinitions=panel_10,
    ElementRow=panel_11,
    ElementRowSpan=1,
    ElementColumnSpan=1)
value_list_7 = ValueList({"Left": 0, "Center": 1, "Right": 2}, selected="Left")
panel_12 = Panel(number_13)
panel_13 = Panel(number_17)
panel_14 = Panel(number_24)
panel_15 = Panel(number_27)
panel_16 = Panel(number_35)
set_label_contents = SetLabelContents(LabelToModify=create_label_40, NewLabelContents=panel_16)
panel_17 = Panel(number_22)
panel_18 = Panel(number)
panel_19 = Panel(number_2)
panel_20 = Panel(number_33)
panel_21 = Panel(integer)
panel_22 = Panel(number_34)
panel_23 = Panel(number_31)
set_label_contents_2 = SetLabelContents(LabelToModify=create_label_39, NewLabelContents=panel_23)
adjust_element_positioning_7 = AdjustElementPositioning(
    ElementsToAdjust=merge_4,
    Margin=Slider(0, range=0..1000),
    AbsolutePositioning=Toggle(True),
    Width=Slider(610, range=0..1000),
    Height=Slider(60, range=0..1000),
    HorizontalAlignment=value_list_7)
panel_24 = Panel("""3*
2*
1*""")
panel_25 = Panel("""0
1
2""")
merge_5 = Merge(Data1=create_border_3, Data2=create_grid_4, Data3=create_grid_3)
panel_26 = Panel(merge_5)
create_grid_5 = CreateGrid(UIElements=merge_5, ColumnDefinitions=panel_24, ElementColumn=panel_25, ElementRowSpan=1, ElementColumnSpan=1)
number_36 = Number(panel_14)
number_37 = Number(panel_15)
number_38 = Number(panel_13)
addition_14 = Addition(A=panel_18, B=panel_22)
negative = Negative(Value=number_36)
multiplication_18 = Multiplication(A=number_37, B=Slider(2, range=0..10))
construct_point_5 = ConstructPoint(XCoordinate=number_38, YCoordinate=number_38, ZCoordinate=addition_14)
xz_plane = XZPlane(Origin=construct_point_5)
number_39 = Number(panel_21)
multiplication_19 = Multiplication(A=number_38, B=Slider(-2, range=-10..10))
unit_z_5 = UnitZ(Factor=multiplication_18)
rectangle = Rectangle(Plane=xz_plane, XSize=negative, YSize=number_37, Radius=0)  # -> Rectangle, Length
unit_y = UnitY(Factor=multiplication_19)
extrude_5 = Extrude(Base=rectangle.Rectangle, Direction=unit_y)
multiplication_20 = Multiplication(A=number_38, B=Slider(2, range=0..10))
cap_holes_2 = CapHoles(Brep=extrude_5)
subtraction_15 = Subtraction(A=number_36, B=multiplication_20)
linear_array = LinearArray(Geometry=cap_holes_2, Direction=unit_z_5, Count=number_39)  # -> Geometry, Transform
dispatch = Dispatch(List=linear_array.Geometry, DispatchPattern=invert([True, False]))  # -> ListA, ListB
unit_x = UnitX(Factor=subtraction_15)  # -> flatten(UnitVector)
move = Move(Geometry=dispatch.ListA, Motion=unit_x)  # -> Geometry, Transform
solid_difference_2 = SolidDifference(BrepsA=solid_difference, BrepsB=[move.Geometry, dispatch.ListB])
brep = Brep(solid_difference_2)
set_3d_view = Set3DView(_3DView=create_3d_view_3, MeshToDisplay=brep, MeshColors=value_listener.Values)

get_screen_dimensions = GetScreenDimensions()  # -> Width, Height

# ----
# Ln
# Lw
# Max Angle per Notch (a) = 2sininv(Ln/2(Ro+Lw))
# Ro
number_slider_3 = Slider(2, range=0..10)

# ----
# Base Extrude
construct_point_6 = ConstructPoint(XCoordinate=0, YCoordinate=0, ZCoordinate=0)

# ----
# L
# Ln
# N
# Le
# Le
number_slider_4 = Slider(2, range=0..10)

# ----
# Ln
# Lw
# Doubleclick Me!
# Max Angle per Notch (a) = 2sininv(Ln/2(Ro+Lw))
# Ro
# Step 9: Angle per Notch Calculation
number_slider_5 = Slider(2, range=0..10)

# ----
# Catheter Tip/Base Inner Radius:
# Minimum value set to be 1 mm
# Can be incremented by 0.1 mm
# Maximum value set to be 15.0 mm
# Start value regulated
inner_radius_min_2 = Slider(1, range=1..10)
minimum_resolution_4 = Slider(10, range=0..100)
min_step_4 = Slider(0.1, range=0..1)

# ----
# L
# Ln
# N
# Le
# Le
number_slider_6 = Slider(2, range=0..10)

# ----
# Notch Length (Ln)
# Ln
# Notch Length Compute:
# Minimum Ln set to be 1 mm by slider.
# Maximum will be Ro.
# This block sets Ln within permissible ranges dynamically
# Step 6: Notch Length Calculate (Ln)
number_slider_7 = Slider(2, range=0..10)

# ----
# L
# Ln
number_slider_8 = Slider(2, range=0..10)

# ----
# Base Extrude
construct_point_7 = ConstructPoint(XCoordinate=0, YCoordinate=0, ZCoordinate=0)

# ----
# Unidirectional
# Data Merge Order:
# 0. Ri
# 1. Ro
# 2. Rb
# 
# 3. Lb
# 4. L
# 
# 5. w
# 6. Lw
# 7. Ln
# 
# 8. N
# 9. Lef
# 
# 10. a
# 11. phi
# Ri
# Ro
# Rb
# Lb
# L
# w
# Lw
# Ln
# N
# Lef
# a
# phi
merge_6 = Merge(
    Data1=create_label,
    Data2=create_slider,
    Data3=create_color_picker,
    Data4=create_label_4,
    Data5=create_label_2,
    Data6=create_label_5,
    Data7=create_label_3)

# ----
# Create Rows
panel_27 = Panel("""75
60
60
60
60
60
60
60
60
80
60
60
60
60""")
panel_28 = Panel("""0
1
2
3
4
5
6
7
8
9
10
11
12
13""")
create_grid_6 = CreateGrid(
    UIElements=merge_6,
    Width=Slider(650, range=0..1000),
    Height=Slider(920, range=0..1000),
    RowDefinitions=panel_27,
    ElementRow=panel_28,
    ElementRowSpan=1,
    ElementColumnSpan=1)

# ----
# Position the control elements
number_slider_9 = Slider(0, range=0..1000)
value_list_8 = ValueList({"Left": 0, "Center": 1, "Right": 2}, selected="Left")
adjust_element_positioning_8 = AdjustElementPositioning(
    ElementsToAdjust=merge_6,
    Margin=number_slider_9,
    AbsolutePositioning=Toggle(True),
    Width=Slider(610, range=0..1000),
    Height=Slider(60, range=0..1000),
    HorizontalAlignment=value_list_8)

# ----
# Create Columns
panel_29 = Panel("""3*
2*
1*""")
panel_30 = Panel("""0
1
2""")
merge_7 = Merge(Data1=create_border, Data2=create_grid_6, Data3=create_grid)
panel_31 = Panel(merge_7)
create_grid_7 = CreateGrid(UIElements=merge_7, ColumnDefinitions=panel_29, ElementColumn=panel_30, ElementRowSpan=1, ElementColumnSpan=1)

# ----
# Start Value Regulated
# Catheter Tip Outer Radius:
# Minimum value to be 10 mm more than outer radius of tip.
# Can be incremented by 0.1 mm
# Maximum value set to be 30.0 mm
minimum_resolution_5 = Slider(10, range=0..100)
min_step_5 = Slider(0.1, range=0..1)

# ----
# Start Value Regulated
# Catheter Tip Outer Radius:
# Minimum value set to be 1 mm more than inner radius.
# Can be incremented by 0.1 mm
# Maximum value set to be 20.0 mm
minimum_resolution_6 = Slider(10, range=0..100)
min_step_6 = Slider(0.1, range=0..1)

# ----
# Catheter Tip/Base Inner Radius:
# Minimum value set to be 1 mm
# Can be incremented by 0.1 mm
# Maximum value set to be 15.0 mm
# Start value regulated
# Step 1: Catheter Tip/Base Inner Radius
inner_radius_min_3 = Slider(1, range=1..10)
minimum_resolution_7 = Slider(10, range=0..100)
min_step_7 = Slider(0.1, range=0..1)

# ----
# L
# Ln
# No. of Notch Calculator:
# N has to be integer.
# N = (L-2Le+Ln)/(2Ln)
number_slider_10 = Slider(2, range=0..10)

# ----
# Lw
# End Value Regulated
number_slider_11 = Slider(2, range=0..10)

# ----
# Notch Overcut (Lw)
# Ro
# Ri
number_slider_12 = Slider(10, range=0..10)

# ----
# Bidirectional Symmetric
# Ro
# Lw
# Ln
# N
merge_8 = Merge(
    Data1=create_label_6,
    Data2=create_slider_2,
    Data3=create_color_picker_2,
    Data4=create_label_9,
    Data5=create_label_7,
    Data6=create_label_10,
    Data7=create_label_8)

# ----
# Create Rows
panel_32 = Panel("""75
60
60
60
60
60
60
60
60
60
60
60
60
60""")
panel_33 = Panel("""0
1
2
3
4
5
6
7
8
9
10
11
12
13""")
create_grid_8 = CreateGrid(
    UIElements=merge_8,
    Width=Slider(650, range=0..1000),
    Height=Slider(920, range=0..1000),
    RowDefinitions=panel_32,
    ElementRow=panel_33,
    ElementRowSpan=1,
    ElementColumnSpan=1)

# ----
# Position the control elements
number_slider_13 = Slider(0, range=0..1000)
value_list_9 = ValueList({"Left": 0, "Center": 1, "Right": 2}, selected="Left")
adjust_element_positioning_9 = AdjustElementPositioning(
    ElementsToAdjust=merge_8,
    Margin=number_slider_13,
    AbsolutePositioning=Toggle(True),
    Width=Slider(610, range=0..1000),
    Height=Slider(60, range=0..1000),
    HorizontalAlignment=value_list_9)

# ----
# Create Columns
panel_34 = Panel("""3*
2*
1*""")
panel_35 = Panel("""0
1
2""")
merge_9 = Merge(Data1=create_border_2, Data2=create_grid_8, Data3=create_grid_2)
panel_36 = Panel(merge_9)
create_grid_9 = CreateGrid(UIElements=merge_9, ColumnDefinitions=panel_34, ElementColumn=panel_35, ElementRowSpan=1, ElementColumnSpan=1)

# ----
# Lw
# End Value Regulated
number_slider_14 = Slider(10, range=0..10)

# ----
# Start Value Regulated
# Rb
# Catheter Tip Outer Radius:
# Minimum value to be 10 mm more than outer radius of tip.
# Can be incremented by 0.1 mm
# Maximum value set to be 30.0 mm
# Step 3: Catheter Base Outer Radius
minimum_resolution_8 = Slider(10, range=0..100)
min_step_8 = Slider(0.1, range=0..1)

# ----
# Start Value Regulated
# Ri
# Catheter Tip Outer Radius:
# Minimum value set to be 1 mm more than inner radius.
# Can be incremented by 0.1 mm
# Maximum value set to be 20.0 mm
# Step 2: Catheter Tip Outer Radius
minimum_resolution_9 = Slider(10, range=0..100)
min_step_9 = Slider(0.1, range=0..1)

# ----
# Notch Overcut  (Lw) Compute:
# Minimum Lw set to be 0.
# Maximum Lw set to be Ri+Ro.
# This block sets Lw within permissible ranges dynamically
# End Value Regulated
# Step 5: Notch Overcut (Lw)
number_slider_15 = Slider(10, range=0..10)

# ----
# Update Values
value_listener_3 = ValueListener(Elements=create_color_picker, SomeProperty=True)  # -> Values, Indices
value_listener_4 = ValueListener(Elements=create_slider, SomeProperty=True)  # -> Values, Indices
explode_tree_2 = ExplodeTree(Data=value_listener_4.Values)  # -> Branch0, Branch1, Branch2, Branch3, Branch4, Branch5, Branch6, Branch7

# ----
# Rb
# Lb
# Ri
# Catheter Extrude
# Ro
# L
# Step 4: Catheter Build
number_40 = Number(explode_tree_2.Branch3)
number_41 = Number(explode_tree_2.Branch4)
construct_point_8 = ConstructPoint(XCoordinate=0, YCoordinate=0, ZCoordinate=number_40)
unit_z_6 = UnitZ(Factor=number_41)

# ----
# Ri
# Ri
# Step 1: Catheter Tip/Base Inner Radius
number_42 = Number(explode_tree_2.Branch0)

subtraction_16 = Subtraction(A=number_42, B=inner_radius_min_2)
multiplication_21 = Multiplication(A=minimum_resolution_4, B=number_42)
multiplication_22 = Multiplication(A=subtraction_16, B=minimum_resolution_4)
subtraction_17 = Subtraction(A=multiplication_21, B=minimum_resolution_4)
addition_15 = Addition(A=multiplication_22, B=Slider(1, range=0..1))
series_4 = Series(Start=inner_radius_min_2, Step=min_step_4, Count=addition_15)
list_item_6 = ListItem(List=series_4, Index=subtraction_17, Wrap=True)

number_43 = Number(list_item_6)

number_44 = Number(number_43)
circle_7 = Circle(Plane=construct_point_8, Radius=number_44)

# ----
# Ro
# Ri
# Ro
# Step 2: Catheter Tip Outer Radius
number_45 = Number(number_43)
number_46 = Number(explode_tree_2.Branch1)

subtraction_18 = Subtraction(A=number_46, B=number_45)
subtraction_19 = Subtraction(A=number_46, B=number_45)
multiplication_23 = Multiplication(A=subtraction_19, B=minimum_resolution_6)
multiplication_24 = Multiplication(A=subtraction_18, B=minimum_resolution_6)
addition_16 = Addition(A=multiplication_23, B=Slider(1, range=0..1))
series_5 = Series(Start=number_45, Step=min_step_6, Count=addition_16)
list_item_7 = ListItem(List=series_5, Index=multiplication_24, Wrap=True)

number_47 = Number(list_item_7)

number_48 = Number(number_47)
circle_8 = Circle(Plane=construct_point_8, Radius=number_48)
ruled_surface_3 = RuledSurface(CurveA=circle_7, CurveB=circle_8)
extrude_6 = Extrude(Base=ruled_surface_3, Direction=unit_z_6)

number_49 = Number(number_44)
number_50 = Number(number_48)
number_51 = Number(explode_tree_2.Branch5)
addition_17 = Addition(A=number_50, B=number_49)
subtraction_20 = Subtraction(A=addition_17, B=number_51)
construct_domain_3 = ConstructDomain(DomainStart=number_51, DomainEnd=addition_17)
multiplication_25 = Multiplication(A=subtraction_20, B=number_slider_12)
addition_18 = Addition(A=multiplication_25, B=Slider(1, range=0..1))
range_3 = Range(Domain=construct_domain_3, Steps=addition_18)
subtraction_21 = Subtraction(A=number_50, B=number_49)
list_item_8 = ListItem(List=range_3, Index=Slider(0, range=0..100), Wrap=True)

# ----
# Wall Width (w)
# Lw
# Notch Overcut  (Lw) Compute:
# Minimum Lw set to be 0.
# Maximum Lw set to be Ri+Ro.
# This block sets Lw within permissible ranges dynamically
# End Value Regulated
# Step 5: Notch Overcut (Lw)
number_52 = Number(list_item_8)
number_53 = Number(subtraction_21)

# ----
# Ro
# Rb
# Rb
# Step 3: Catheter Base Outer Radius
number_54 = Number(number_47)
number_55 = Number(explode_tree_2.Branch2)

subtraction_22 = Subtraction(A=number_55, B=number_54)
subtraction_23 = Subtraction(A=number_55, B=number_54)
multiplication_26 = Multiplication(A=subtraction_23, B=minimum_resolution_5)
multiplication_27 = Multiplication(A=minimum_resolution_5, B=subtraction_22)
addition_19 = Addition(A=multiplication_26, B=Slider(1, range=0..1))
series_6 = Series(Start=number_54, Step=min_step_5, Count=addition_19)
list_item_9 = ListItem(List=series_6, Index=multiplication_27, Wrap=True)

number_56 = Number(list_item_9)

number_57 = Number(number_56)

circle_9 = Circle(Plane=construct_point_6, Radius=number_44)
circle_10 = Circle(Plane=construct_point_6, Radius=number_57)
unit_z_7 = UnitZ(Factor=number_40)
ruled_surface_4 = RuledSurface(CurveA=circle_9, CurveB=circle_10)

number_58 = Number(number_54)

subtraction_24 = Subtraction(A=number_57, B=number_48)
subtraction_25 = Subtraction(A=number_48, B=number_44)
division_5 = Division(A=subtraction_24, B=Slider(2, range=0..10))
division_6 = Division(A=subtraction_25, B=Slider(2, range=0..10))
addition_20 = Addition(A=number_48, B=division_5)
addition_21 = Addition(A=division_6, B=number_44)
construct_point_9 = ConstructPoint(XCoordinate=addition_20, YCoordinate=0, ZCoordinate=0)
addition_22 = Addition(A=number_40, B=number_41)
construct_point_10 = ConstructPoint(XCoordinate=addition_21, YCoordinate=0, ZCoordinate=0)
unit_z_8 = UnitZ(Factor=addition_22)
circle_11 = Circle(Plane=construct_point_9, Radius=Slider(3.4, range=0..3.4))
circle_12 = Circle(Plane=construct_point_10, Radius=Slider(1, range=0..1))
polar_array_3 = PolarArray(Geometry=circle_11, Plane=PlaneXY(0, 0, 0), Count=Slider(4, range=0..10), Angle=6.283185307)  # -> Geometry, Transform
unit_z_9 = UnitZ(Factor=number_40)
polar_array_4 = PolarArray(Geometry=circle_12, Plane=PlaneXY(0, 0, 0), Count=Slider(2, range=0..10), Angle=6.283185307)  # -> Geometry, Transform
extrude_7 = Extrude(Base=polar_array_4.Geometry, Direction=unit_z_8)  # -> flatten(Extrusion)

number_59 = Number(explode_tree_2.Branch6)

# ----
# Number of notches (N)
# Le
# No. of Notch Calculator:
# N has to be integer.
# N = (L-2Le+Ln)/(2Ln)
# Step 7: Number of Notches (N)
number_60 = Number(explode_tree_2.Branch7)

number_61 = Number(number_52)

number_62 = Number(number_61)
addition_23 = Addition(A=number_62, B=number_58)
multiplication_28 = Multiplication(A=number_slider_3, B=addition_23)

multiplication_29 = Multiplication(A=number_61, B=number_slider_7)

construct_domain_4 = ConstructDomain(DomainStart=number_59, DomainEnd=multiplication_29)
subtraction_26 = Subtraction(A=multiplication_29, B=number_59)
multiplication_30 = Multiplication(A=subtraction_26, B=number_slider_14)
addition_24 = Addition(A=multiplication_30, B=Slider(1, range=0..1))
range_4 = Range(Domain=construct_domain_4, Steps=addition_24)
list_item_10 = ListItem(List=range_4, Index=Slider(0, range=0..100), Wrap=True)

number_63 = Number(list_item_10)

number_64 = Number(number_41)
multiplication_31 = Multiplication(A=number_slider_8, B=number_60)
subtraction_27 = Subtraction(A=number_64, B=multiplication_31)
number_65 = Number(number_63)
addition_25 = Addition(A=subtraction_27, B=number_65)
multiplication_32 = Multiplication(A=Slider(2, range=0..10), B=number_65)
integer_division_2 = IntegerDivision(A=addition_25, B=multiplication_32)

integer_4 = Integer(integer_division_2)

integer_5 = Integer(integer_4)
multiplication_33 = Multiplication(A=integer_5, B=number_slider_4)
subtraction_28 = Subtraction(A=multiplication_33, B=Slider(1, range=0..1))
number_66 = Number(number_65)
number_67 = Number(number_60)
multiplication_34 = Multiplication(A=number_66, B=subtraction_28)
multiplication_35 = Multiplication(A=number_67, B=Slider(2, range=0..10))
number_68 = Number(number_64)
addition_26 = Addition(A=multiplication_34, B=multiplication_35)
subtraction_29 = Subtraction(A=number_68, B=addition_26)
division_7 = Division(A=subtraction_29, B=Slider(2, range=0..10))
number_69 = Number(number_60)
addition_27 = Addition(A=division_7, B=number_69)

number_70 = Number(number_66)
division_8 = Division(A=number_70, B=multiplication_28)
arcsine_2 = ArcSine(Value=division_8)
degrees_2 = Degrees(Radians=arcsine_2)
multiplication_36 = Multiplication(A=Slider(2, range=0..10), B=degrees_2)

# ----
# Angle per Notch (a)
# Step 9: Angle per Notch Calculation
number_71 = Number(multiplication_36)

# ----
# Step 8: Tip End Thickness
# Compensation
# Lef
# As N is integer, to adjust for extra length, the thickness of both ends of the catheter is increased by half of residual length to keep catheter height fixed.
# Lef= Le + ((L-(2N-1)Ln)/2)
number_72 = Number(addition_27)

# ----
# a
# Total Bend Angle (phi)
# Total bend angle (phi) = N*a
# Step 10: Total Bend Angle Calculation
number_73 = Number(number_71)

# ----
# Number of notches (N)
integer_6 = Integer(integer_5)
multiplication_37 = Multiplication(A=number_73, B=integer_6)

number_74 = Number(multiplication_37)

extrude_8 = Extrude(Base=polar_array_3.Geometry, Direction=unit_z_9)  # -> flatten(Extrusion)
panel_37 = Panel(number_43)
panel_38 = Panel(number_47)
panel_39 = Panel(number_52)
panel_40 = Panel(number_63)
panel_41 = Panel(number_74)
panel_42 = Panel(number_56)
panel_43 = Panel(number_40)
panel_44 = Panel(number_41)
panel_45 = Panel(number_53)
panel_46 = Panel(integer_4)
panel_47 = Panel(number_72)
panel_48 = Panel(number_71)

cap_holes_3 = CapHoles(Brep=[extrude_7, extrude_8])

extrude_9 = Extrude(Base=ruled_surface_4, Direction=unit_z_7)
solid_union_2 = SolidUnion(Breps=flatten([extrude_6, extrude_9]))
solid_difference_3 = SolidDifference(BrepsA=solid_union_2, BrepsB=cap_holes_3)

# ----
# Ro
# Lw
# Ln
# N
number_75 = Number(panel_39)
number_76 = Number(panel_40)
number_77 = Number(panel_38)
addition_28 = Addition(A=panel_43, B=panel_47)
negative_2 = Negative(Value=number_75)
multiplication_38 = Multiplication(A=number_76, B=Slider(2, range=0..10))
construct_point_11 = ConstructPoint(XCoordinate=number_77, YCoordinate=0, ZCoordinate=addition_28)
xz_plane_2 = XZPlane(Origin=construct_point_11)
negative_3 = Negative(Value=number_77)
unit_y_2 = UnitY(Factor=number_77)
rectangle_2 = Rectangle(Plane=xz_plane_2, XSize=negative_2, YSize=number_76, Radius=0)  # -> Rectangle, Length
unit_y_3 = UnitY(Factor=negative_3)
unit_z_10 = UnitZ(Factor=multiplication_38)
number_78 = Number(panel_46)
extrude_10 = Extrude(Base=rectangle_2.Rectangle, Direction=unit_y_3)
extrude_11 = Extrude(Base=rectangle_2.Rectangle, Direction=unit_y_2)
brep_join = BrepJoin(Breps=[extrude_11, extrude_10])  # -> Breps, Closed
linear_array_2 = LinearArray(Geometry=brep_join.Breps, Direction=unit_z_10, Count=number_78)  # -> Geometry, Transform
cap_holes_4 = CapHoles(Brep=linear_array_2.Geometry)
panel_49 = Panel(linear_array_2.Geometry)

solid_difference_4 = SolidDifference(BrepsA=solid_difference_3, BrepsB=cap_holes_4)

set_label_contents_3 = SetLabelContents(LabelToModify=create_label_2, NewLabelContents=panel_48)
set_label_contents_4 = SetLabelContents(LabelToModify=create_label_3, NewLabelContents=panel_41)
brep_2 = Brep(solid_difference_4)
set_3d_view_2 = Set3DView(_3DView=create_3d_view, MeshToDisplay=brep_2, MeshColors=value_listener_3.Values)

# ----
# Update Values
value_listener_5 = ValueListener(Elements=create_color_picker_2, SomeProperty=True)  # -> Values, Indices
value_listener_6 = ValueListener(Elements=create_slider_2, SomeProperty=True)  # -> Values, Indices
explode_tree_3 = ExplodeTree(Data=value_listener_6.Values)  # -> Branch0, Branch1, Branch2, Branch3, Branch4, Branch5, Branch6, Branch7

# ----
# Rb
# Lb
# Ri
# Catheter Extrude
# Ro
# L
# Step 4: Catheter Build
number_79 = Number(explode_tree_3.Branch3)
number_80 = Number(explode_tree_3.Branch4)
construct_point_12 = ConstructPoint(XCoordinate=0, YCoordinate=0, ZCoordinate=number_79)
unit_z_11 = UnitZ(Factor=number_80)

# ----
# Ri
# Ri
number_81 = Number(explode_tree_3.Branch0)

subtraction_30 = Subtraction(A=number_81, B=inner_radius_min_3)
multiplication_39 = Multiplication(A=minimum_resolution_7, B=number_81)
multiplication_40 = Multiplication(A=subtraction_30, B=minimum_resolution_7)
subtraction_31 = Subtraction(A=multiplication_39, B=minimum_resolution_7)
addition_29 = Addition(A=multiplication_40, B=Slider(1, range=0..1))
series_7 = Series(Start=inner_radius_min_3, Step=min_step_7, Count=addition_29)
list_item_11 = ListItem(List=series_7, Index=subtraction_31, Wrap=True)

number_82 = Number(list_item_11)

number_83 = Number(number_82)
circle_13 = Circle(Plane=construct_point_12, Radius=number_83)

# ----
# Ro
# Ro
number_84 = Number(explode_tree_3.Branch1)

number_85 = Number(number_82)
subtraction_32 = Subtraction(A=number_84, B=number_85)
subtraction_33 = Subtraction(A=number_84, B=number_85)
multiplication_41 = Multiplication(A=subtraction_33, B=minimum_resolution_9)
multiplication_42 = Multiplication(A=subtraction_32, B=minimum_resolution_9)
addition_30 = Addition(A=multiplication_41, B=Slider(1, range=0..1))
series_8 = Series(Start=number_85, Step=min_step_9, Count=addition_30)
list_item_12 = ListItem(List=series_8, Index=multiplication_42, Wrap=True)

number_86 = Number(list_item_12)

# ----
# Ro
# Rb
number_87 = Number(number_86)

number_88 = Number(explode_tree_3.Branch2)
subtraction_34 = Subtraction(A=number_88, B=number_87)
subtraction_35 = Subtraction(A=number_88, B=number_87)
multiplication_43 = Multiplication(A=subtraction_35, B=minimum_resolution_8)
multiplication_44 = Multiplication(A=minimum_resolution_8, B=subtraction_34)
addition_31 = Addition(A=multiplication_43, B=Slider(1, range=0..1))
series_9 = Series(Start=number_87, Step=min_step_8, Count=addition_31)
list_item_13 = ListItem(List=series_9, Index=multiplication_44, Wrap=True)

number_89 = Number(list_item_13)

number_90 = Number(number_87)

number_91 = Number(number_87)
number_92 = Number(number_89)
circle_14 = Circle(Plane=construct_point_12, Radius=number_91)
ruled_surface_5 = RuledSurface(CurveA=circle_13, CurveB=circle_14)
extrude_12 = Extrude(Base=ruled_surface_5, Direction=unit_z_11)

subtraction_36 = Subtraction(A=number_92, B=number_91)
subtraction_37 = Subtraction(A=number_91, B=number_83)
division_9 = Division(A=subtraction_36, B=Slider(2, range=0..10))
division_10 = Division(A=subtraction_37, B=Slider(2, range=0..10))
addition_32 = Addition(A=number_91, B=division_9)
addition_33 = Addition(A=division_10, B=number_83)
addition_34 = Addition(A=number_79, B=number_80)
construct_point_13 = ConstructPoint(XCoordinate=addition_32, YCoordinate=0, ZCoordinate=0)
construct_point_14 = ConstructPoint(XCoordinate=addition_33, YCoordinate=0, ZCoordinate=0)
circle_15 = Circle(Plane=construct_point_13, Radius=Slider(3.4, range=0..3.4))
unit_z_12 = UnitZ(Factor=addition_34)
circle_16 = Circle(Plane=construct_point_14, Radius=Slider(1, range=0..1))
unit_z_13 = UnitZ(Factor=number_79)
polar_array_5 = PolarArray(Geometry=circle_15, Plane=PlaneXY(0, 0, 0), Count=Slider(4, range=0..10), Angle=6.283185307)  # -> Geometry, Transform
polar_array_6 = PolarArray(Geometry=circle_16, Plane=PlaneXY(0, 0, 0), Count=Slider(2, range=0..10), Angle=6.283185307)  # -> Geometry, Transform
extrude_13 = Extrude(Base=polar_array_5.Geometry, Direction=unit_z_13)  # -> flatten(Extrusion)
extrude_14 = Extrude(Base=polar_array_6.Geometry, Direction=unit_z_12)  # -> flatten(Extrusion)
cap_holes_5 = CapHoles(Brep=[extrude_14, extrude_13])

circle_17 = Circle(Plane=construct_point_7, Radius=number_83)
circle_18 = Circle(Plane=construct_point_7, Radius=number_92)
unit_z_14 = UnitZ(Factor=number_79)
ruled_surface_6 = RuledSurface(CurveA=circle_17, CurveB=circle_18)

extrude_15 = Extrude(Base=ruled_surface_6, Direction=unit_z_14)
solid_union_3 = SolidUnion(Breps=flatten([extrude_12, extrude_15]))
solid_difference_5 = SolidDifference(BrepsA=solid_union_3, BrepsB=cap_holes_5)  # -> flatten(Result)

panel_50 = Panel(solid_difference_5)

# ----
# Notch Overcut (Lw)
# Wall Width (w)
# Ro
# Lw
# Ri
number_93 = Number(number_83)
number_94 = Number(number_91)
number_95 = Number(explode_tree_3.Branch5)

subtraction_38 = Subtraction(A=number_94, B=number_93)
construct_domain_5 = ConstructDomain(DomainStart=number_95, DomainEnd=number_93)
subtraction_39 = Subtraction(A=number_93, B=number_95)
multiplication_45 = Multiplication(A=subtraction_39, B=number_slider_15)
addition_35 = Addition(A=multiplication_45, B=Slider(1, range=0..1))
range_5 = Range(Domain=construct_domain_5, Steps=addition_35)
list_item_14 = ListItem(List=range_5, Index=Slider(0, range=0..100), Wrap=True)

number_96 = Number(list_item_14)
number_97 = Number(subtraction_38)

# ----
# Notch Length (Ln)
# Ln
# Notch Length Compute:
# Minimum Ln set to be 1 mm by slider.
# Maximum will be Ro.
# This block sets Ln within permissible ranges dynamically
# Step 6: Notch Length Calculate (Ln)
number_98 = Number(explode_tree_3.Branch6)

number_99 = Number(number_96)
multiplication_46 = Multiplication(A=number_99, B=number_slider_11)
construct_domain_6 = ConstructDomain(DomainStart=number_98, DomainEnd=multiplication_46)
subtraction_40 = Subtraction(A=multiplication_46, B=number_98)
multiplication_47 = Multiplication(A=subtraction_40, B=Slider(10, range=0..10))
addition_36 = Addition(A=multiplication_47, B=Slider(1, range=0..1))
range_6 = Range(Domain=construct_domain_6, Steps=addition_36)
list_item_15 = ListItem(List=range_6, Index=Slider(0, range=0..100), Wrap=True)

number_100 = Number(list_item_15)

number_101 = Number(number_99)
addition_37 = Addition(A=number_101, B=number_90)
multiplication_48 = Multiplication(A=number_slider_5, B=addition_37)

# ----
# Number of notches (N)
# Le
# Step 7: Number of Notches (N)
number_102 = Number(explode_tree_3.Branch7)

number_103 = Number(number_80)
multiplication_49 = Multiplication(A=number_slider_10, B=number_102)
subtraction_41 = Subtraction(A=number_103, B=multiplication_49)
number_104 = Number(number_100)
addition_38 = Addition(A=subtraction_41, B=number_104)
multiplication_50 = Multiplication(A=Slider(2, range=0..10), B=number_104)
integer_division_3 = IntegerDivision(A=addition_38, B=multiplication_50)

integer_7 = Integer(integer_division_3)

integer_8 = Integer(integer_7)
multiplication_51 = Multiplication(A=integer_8, B=number_slider_6)
subtraction_42 = Subtraction(A=multiplication_51, B=Slider(1, range=0..1))
number_105 = Number(number_104)
number_106 = Number(number_102)
multiplication_52 = Multiplication(A=number_105, B=subtraction_42)
multiplication_53 = Multiplication(A=number_106, B=Slider(2, range=0..10))
number_107 = Number(number_103)
addition_39 = Addition(A=multiplication_52, B=multiplication_53)
subtraction_43 = Subtraction(A=number_107, B=addition_39)
division_11 = Division(A=subtraction_43, B=Slider(2, range=0..10))
number_108 = Number(number_102)
addition_40 = Addition(A=division_11, B=number_108)

number_109 = Number(number_105)
division_12 = Division(A=number_109, B=multiplication_48)
arcsine_3 = ArcSine(Value=division_12)
degrees_3 = Degrees(Radians=arcsine_3)
multiplication_54 = Multiplication(A=Slider(2, range=0..10), B=degrees_3)

# ----
# Angle per Notch (a)
number_110 = Number(multiplication_54)

# ----
# a
# Number of notches (N)
# Total bend angle (phi) = N*a
# Step 10: Total Bend Angle Calculation
number_111 = Number(number_110)
integer_9 = Integer(integer_8)
multiplication_55 = Multiplication(A=number_111, B=integer_9)

# ----
# Total Bend Angle (phi)
number_112 = Number(multiplication_55)

# ----
# Step 8: Tip End Thickness
# Compensation
# Lef
# As N is integer, to adjust for extra length, the thickness of both ends of the catheter is increased by half of residual length to keep catheter height fixed.
# Lef= Le + ((L-(2N-1)Ln)/2)
number_113 = Number(addition_40)

# ----
# Ri
# Ro
# Rb
# Data Merge Order:
# 0. Ri
# 1. Ro
# 2. Rb
# 
# 3. Lb
# 4. L
# 
# 5. w
# 6. Lw
# 7. Ln
# 
# 8. N
# 9. Lef
# 
# 10. a
# 11. phi
# Lb
# L
# w
# Lw
# Ln
# N
# Lef
# a
# phi
panel_51 = Panel(number_82)
panel_52 = Panel(number_86)
panel_53 = Panel(number_89)
panel_54 = Panel(number_97)
panel_55 = Panel(number_96)
panel_56 = Panel(number_100)
panel_57 = Panel(integer_7)
panel_58 = Panel(number_113)
panel_59 = Panel(number_110)
panel_60 = Panel(number_112)
panel_61 = Panel(number_79)
panel_62 = Panel(number_80)

set_label_contents_5 = SetLabelContents(LabelToModify=create_label_7, NewLabelContents=panel_59)
set_label_contents_6 = SetLabelContents(LabelToModify=create_label_8, NewLabelContents=panel_60)

addition_41 = Addition(A=panel_61, B=panel_58)
number_114 = Number(panel_55)
number_115 = Number(panel_52)
number_116 = Number(panel_56)
negative_4 = Negative(Value=number_115)
negative_5 = Negative(Value=number_115)
negative_6 = Negative(Value=number_114)
construct_point_15 = ConstructPoint(XCoordinate=negative_5, YCoordinate=negative_4, ZCoordinate=addition_41)
construct_point_16 = ConstructPoint(XCoordinate=number_115, YCoordinate=negative_4, ZCoordinate=addition_41)
multiplication_56 = Multiplication(A=number_116, B=Slider(2, range=0..10))
xz_plane_3 = XZPlane(Origin=construct_point_15)
xz_plane_4 = XZPlane(Origin=construct_point_16)
rectangle_3 = Rectangle(Plane=xz_plane_4, XSize=negative_6, YSize=number_116, Radius=0)  # -> Rectangle, Length
rectangle_4 = Rectangle(Plane=xz_plane_3, XSize=number_114, YSize=number_116, Radius=0)  # -> Rectangle, Length
multiplication_57 = Multiplication(A=number_115, B=Slider(-2, range=-10..10))
unit_z_15 = UnitZ(Factor=multiplication_56)
box_rectangle = BoxRectangle(Rectangle=rectangle_4.Rectangle, Height=multiplication_57)
box_rectangle_2 = BoxRectangle(Rectangle=rectangle_3.Rectangle, Height=multiplication_57)
number_117 = Number(panel_57)
linear_array_3 = LinearArray(Geometry=box_rectangle_2, Direction=unit_z_15, Count=number_117)  # -> Geometry, Transform

linear_array_4 = LinearArray(Geometry=box_rectangle, Direction=unit_z_15, Count=number_117)  # -> Geometry, Transform
solid_union_4 = SolidUnion(Breps=[linear_array_4.Geometry, linear_array_3.Geometry])

solid_difference_6 = SolidDifference(BrepsA=solid_difference_5, BrepsB=solid_union_4)

brep_3 = Brep(solid_difference_6)
set_3d_view_3 = Set3DView(_3DView=create_3d_view_2, MeshToDisplay=brep_3, MeshColors=value_listener_5.Values)

panel_63 = Panel(solid_difference_6)

# ----
# Add border
# Position the 3D model
# Inner Radius i/p (Ri)
# Position the control elements
# Tip Outer Radius i/p (Ro)
# Base Outer Radius i/p (Rb)
# Base Height (Lb)
# Create Columns
# Catheter Height (L)
# Notch Overcut (Lw1)
# Create Rows
# Notch Length (Ln1)
# Minimum Tip End Thickness (Le1)
# Notch Overcut (Lw2)
# Notch Length (Ln2)
# Update Values
# Minimum Tip End Thickness (Le2)
# Bidirectional Asymmetric
# Ri
# Ro
# Rb
# Data Merge Order:
# 0. Ri
# 1. Ro
# 2. Rb
# 
# 3. Lb
# 4. L
# 
# 5. w
# 6. Lw
# 7. Ln
# 
# 8. N
# 9. Lef
# 
# 10. a
# 11. phi
# Lb
# L
# Left
# Ro
# Lw1
# Ln1
# w
# N1
# Lw1
# Ln1
# N1
# Right
# Lef1
# a1
# phi1
ro_4 = Slider(12, range=2..20)
le1 = Slider(3, range=2..10)
lw2 = Slider(6, range=0..15)
ri_4 = Slider(8, range=1..15)
rb_4 = Slider(20, range=2..30)
lb_4 = Slider(5, range=5..20)
L_4 = Slider(100, range=20..200)
lw1 = Slider(6, range=0..15)
ln1 = Slider(10, range=1..30)
ln2 = Slider(8, range=1..30)
le2 = Slider(3, range=2..10)
xy_plane_4 = XYPlane(Origin=Point(0, 0, 0))
cylinder_parameters_7 = Slider(68, range=0..100)
cylinder_parameters_8 = Slider(84, range=0..100)
radius_7 = Slider(34, range=0..100)
radius_8 = Slider(1, range=0..3)
cylinder_4 = Cylinder(Base=xy_plane_4, Radius=cylinder_parameters_7, Length=cylinder_parameters_8)
create_label_43 = CreateLabel(LabelText="EDIT THE PARAMETERS BELOW:", LabelSize=radius_7, Justification=radius_8)
create_3d_view_4 = Create3DView(
    MeshToDisplay=cylinder_4,
    MeshColors=RGB(255, 0, 0),
    ViewWidth=Slider(920, range=0..1920),
    ViewHeight=Slider(920, range=0..1080))
create_slider_4 = CreateSlider(
    Slider=[ri_4, ro_4, rb_4, lb_4, L_4, lw1, ln1, le1, lw2, ln2, le2],
    ShowBounds=False,
    ShowTicks=False,
    ShowTooltip=False,
    ShowValLabel=True,
    showLabel=True)
create_color_picker_4 = CreateColorPicker(DefaultColor=ColourSwatch(SwatchColor=RGB(173, 173, 173)))
merge_10 = Merge(Data1=create_label_43, Data2=create_slider_4, Data3=create_color_picker_4)
value_listener_7 = ValueListener(Elements=create_color_picker_4, SomeProperty=True)  # -> Values, Indices
value_listener_8 = ValueListener(Elements=create_slider_4, SomeProperty=True)  # -> Values, Indices
create_border_4 = CreateBorder(
    UIElement=create_3d_view_4,
    BorderThickness=Slider(1, range=0..10),
    BorderColor=ColourSwatch(SwatchColor=RGB(120, 120, 120)),
    CornerRadius=Slider(30, range=0..100))
value_list_10 = ValueList({"Left": 0, "Center": 1, "Right": 2}, selected="Center")
explode_tree_4 = ExplodeTree(Data=value_listener_8.Values)  # -> Branch0, Branch1, Branch2, Branch3, Branch4, Branch5, Branch6, Branch7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
# Lw
# Ro
# a
# Total bend angle (phi) = N*a
adjust_element_positioning_10 = AdjustElementPositioning(
    ElementsToAdjust=create_border_4,
    Margin=Slider(10, range=0..100),
    AbsolutePositioning=Toggle(True),
    Width=Slider(920, range=0..1280),
    Height=Slider(920, range=0..1080),
    HorizontalAlignment=value_list_10)
panel_64 = Panel("""75
60
60
60
60
60
60
60
60
60
60
60
60
60
60
60""")
value_list_11 = ValueList({"Left": 0, "Center": 1, "Right": 2}, selected="Left")
panel_65 = Panel("""0
1
2
3
4
5
6
7
8
9
10
11
12
13
14
15""")
# Number of notches (N)
adjust_element_positioning_11 = AdjustElementPositioning(
    ElementsToAdjust=merge_10,
    Margin=Slider(0, range=0..1000),
    AbsolutePositioning=Toggle(True),
    Width=Slider(610, range=0..1000),
    Height=Slider(50, range=0..1000),
    HorizontalAlignment=value_list_11)
create_grid_10 = CreateGrid(
    UIElements=merge_10,
    Width=Slider(650, range=0..1000),
    Height=Slider(920, range=0..1000),
    RowDefinitions=panel_64,
    ElementRow=panel_65,
    ElementRowSpan=1,
    ElementColumnSpan=1)
panel_66 = Panel("""3*
2*
1*""")
panel_67 = Panel("""0
1
2""")
create_label_44 = CreateLabel(LabelText="Computed Parameters:", LabelSize=Slider(16, range=0..100), Justification=0)
create_label_45 = CreateLabel(LabelText="NA", LabelSize=Slider(14, range=0..100), Justification=0)
create_label_46 = CreateLabel(LabelText="NA", LabelSize=Slider(14, range=0..100), Justification=0)
create_label_47 = CreateLabel(LabelText="NA", LabelSize=Slider(14, range=0..100), Justification=0)
create_label_48 = CreateLabel(LabelText="Theoretical Maximum Bend per Notch (in Degrees):", LabelSize=Slider(14, range=0..100), Justification=0)
create_label_49 = CreateLabel(LabelText="Theoretical Maximum Bending Angle (in Degrees):", LabelSize=Slider(14, range=0..100), Justification=0)
create_label_50 = CreateLabel(LabelText="Theoretical Maximum Bend per Notch (in Degrees):", LabelSize=Slider(14, range=0..100), Justification=0)
create_label_51 = CreateLabel(LabelText="Theoretical Maximum Bending Angle (in Degrees):", LabelSize=Slider(14, range=0..100), Justification=0)
create_label_52 = CreateLabel(LabelText="NA", LabelSize=Slider(14, range=0..100), Justification=0)

# ----
# Position the control elements
# Create Rows
panel_68 = Panel("CONSTRAINTS:")
create_label_53 = CreateLabel(LabelText=panel_68, LabelSize=Slider(30, range=0..100), Justification=0)
create_label_54 = CreateLabel(LabelText="1mm < Inner Radius(Ri) < 19mm", LabelSize=Slider(14, range=0..100), Justification=0)
create_label_55 = CreateLabel(LabelText="Ri + 1mm <= Outer Radius(Ro) <= 20mm", LabelSize=Slider(14, range=0..100), Justification=0)
create_label_56 = CreateLabel(LabelText=" Ro <= Base Radius(Rb) <= 30mm", LabelSize=Slider(14, range=0..100), Justification=0)
create_label_57 = CreateLabel(LabelText=" 5mm <= Base Length(Lb) <= 20mm", LabelSize=Slider(14, range=0..100), Justification=0)
create_label_58 = CreateLabel(LabelText="20mm <= Tip Length(L) <= 400mm", LabelSize=Slider(14, range=0..100), Justification=0)
create_label_59 = CreateLabel(LabelText="0 <= Notch Width(Lw) <= Ro + Ri", LabelSize=Slider(14, range=0..100), Justification=0)
create_label_60 = CreateLabel(LabelText="1mm <= Notch Length(Ln) <= 2Rw", LabelSize=Slider(14, range=0..100), Justification=0)
create_label_61 = CreateLabel(LabelText="1mm <= Tip End Length(Le) <= 10mm", LabelSize=Slider(14, range=0..100), Justification=0)
merge_11 = Merge(
    Data1=create_label_53,
    Data2=create_label_54,
    Data3=create_label_55,
    Data4=create_label_56,
    Data5=create_label_57,
    Data6=create_label_58,
    Data7=create_label_59,
    Data8=create_label_60,
    Data9=create_label_61,
    Data10=create_label_44,
    Data11=create_label_48,
    Data12=create_label_45,
    Data13=create_label_49,
    Data14=create_label_46,
    Data15=create_label_50,
    Data16=create_label_52,
    Data17=create_label_51,
    Data18=create_label_47)
panel_69 = Panel("""60
60
60
60
60
60
60
60
60
60
40
40
40
40
40
40
40
40
40""")
value_list_12 = ValueList({"Left": 0, "Center": 1, "Right": 2}, selected="Left")
panel_70 = Panel("""0
1
2
3
4
5
6
7
8
9
10
11
12
13
14
15
16
17""")
create_grid_11 = CreateGrid(
    UIElements=merge_11,
    Width=Slider(350, range=0..1000),
    Height=Slider(920, range=0..1000),
    RowDefinitions=panel_69,
    ElementRow=panel_70,
    ElementRowSpan=1,
    ElementColumnSpan=1)
adjust_element_positioning_12 = AdjustElementPositioning(
    ElementsToAdjust=merge_11,
    Margin=Slider(10, range=0..1000),
    AbsolutePositioning=Toggle(True),
    Width=Slider(350, range=0..1000),
    Height=Slider(60, range=0..1000),
    HorizontalAlignment=value_list_12)

# ----
# Base Extrude
# Rb
# Lb
# Ri
# Catheter Extrude
# Ro
# L
# Step 4: Catheter Build
number_118 = Number(explode_tree_4.Branch3)
number_119 = Number(explode_tree_4.Branch4)
construct_point_17 = ConstructPoint(XCoordinate=0, YCoordinate=0, ZCoordinate=0)
construct_point_18 = ConstructPoint(XCoordinate=0, YCoordinate=0, ZCoordinate=number_118)
unit_z_16 = UnitZ(Factor=number_118)
addition_42 = Addition(A=number_118, B=number_119)
unit_z_17 = UnitZ(Factor=number_119)
unit_z_18 = UnitZ(Factor=addition_42)
unit_z_19 = UnitZ(Factor=number_118)

# ----
# Notch Overcut (Lw1)
# Wall Width (w)
# Lw1
number_120 = Number(explode_tree_4.Branch5)

# ----
# Ln1
# Lw1
# Angle per Notch (a1)
# Max Angle per Notch (a1) = 2sininv(Ln/2(Ro+Lw1))
# Ro
# Step 9: Angle per Notch Calculation
number_slider_16 = Slider(2, range=0..10)

# ----
# Notch Length (Ln1)
# Ln1
# Notch Length Compute:
# Minimum Ln set to be 1 mm by slider.
# Maximum will be Ro.
# This block sets Ln within permissible ranges dynamically
# Step 6: Notch Length Calculate (Ln1)
number_121 = Number(explode_tree_4.Branch6)

# ----
# Step 8: Tip End Thickness
# Compensation
# L
# Ln1
# N1
# Lef1
# Le1
# Le1
# As N is integer, to adjust for extra length, the thickness of both ends of the catheter is increased by half of residual length to keep catheter height fixed.
# Lef= Le + ((L-(2N-1)Ln)/2)
number_slider_17 = Slider(2, range=0..10)

# ----
# Ri
# Ri
number_122 = Number(explode_tree_4.Branch0)

# ----
# Catheter Tip/Base Inner Radius:
# Minimum value set to be 1 mm
# Can be incremented by 0.1 mm
# Maximum value set to be 15.0 mm
# Start value regulated
# Start Value Regulated
# Step 1: Catheter Tip/Base Inner Radius
inner_radius_min_4 = Slider(1, range=1..10)
minimum_resolution_10 = Slider(10, range=0..100)
subtraction_44 = Subtraction(A=number_122, B=inner_radius_min_4)
multiplication_58 = Multiplication(A=minimum_resolution_10, B=number_122)
multiplication_59 = Multiplication(A=subtraction_44, B=minimum_resolution_10)
min_step_10 = Slider(0.1, range=0..1)
subtraction_45 = Subtraction(A=multiplication_58, B=minimum_resolution_10)
addition_43 = Addition(A=multiplication_59, B=Slider(1, range=0..1))
series_10 = Series(Start=inner_radius_min_4, Step=min_step_10, Count=addition_43)
list_item_16 = ListItem(List=series_10, Index=subtraction_45, Wrap=True)

number_123 = Number(list_item_16)

number_124 = Number(number_123)
circle_19 = Circle(Plane=construct_point_18, Radius=number_124)
circle_20 = Circle(Plane=construct_point_17, Radius=number_124)

# ----
# Ro
# Ri
# Notch Overcut  (Lw1) Compute:
# Minimum Lw set to be 0.
# Maximum Lw set to be Ri+Ro.
# This block sets Lw within permissible ranges dynamically
# End Value Regulated
# Step 5: Notch Overcut (Lw1)
number_125 = Number(number_124)
construct_domain_7 = ConstructDomain(DomainStart=number_120, DomainEnd=number_125)
subtraction_46 = Subtraction(A=number_125, B=number_120)
multiplication_60 = Multiplication(A=subtraction_46, B=Slider(10, range=0..10))
addition_44 = Addition(A=multiplication_60, B=Slider(1, range=0..1))
range_7 = Range(Domain=construct_domain_7, Steps=addition_44)
list_item_17 = ListItem(List=range_7, Index=Slider(0, range=0..100), Wrap=True)

# ----
# Rb
# Rb
number_126 = Number(explode_tree_4.Branch2)

# ----
# Ro
# Ro
# Step 2: Catheter Tip Outer Radius
number_127 = Number(explode_tree_4.Branch1)

# ----
# Ri
# Start Value Regulated
# Catheter Tip Outer Radius:
# Minimum value set to be 1 mm more than inner radius.
# Can be incremented by 0.1 mm
# Maximum value set to be 20.0 mm
number_128 = Number(number_123)
minimum_resolution_11 = Slider(10, range=0..100)
subtraction_47 = Subtraction(A=number_127, B=number_128)
subtraction_48 = Subtraction(A=number_127, B=number_128)
min_step_11 = Slider(0.1, range=0..1)
multiplication_61 = Multiplication(A=subtraction_48, B=minimum_resolution_11)
multiplication_62 = Multiplication(A=subtraction_47, B=minimum_resolution_11)
addition_45 = Addition(A=multiplication_61, B=Slider(1, range=0..1))
series_11 = Series(Start=number_128, Step=min_step_11, Count=addition_45)
list_item_18 = ListItem(List=series_11, Index=multiplication_62, Wrap=True)

number_129 = Number(list_item_18)

# ----
# Ro
# Catheter Tip Outer Radius:
# Minimum value to be 10 mm more than outer radius of tip.
# Can be incremented by 0.1 mm
# Maximum value set to be 30.0 mm
# Step 3: Catheter Base Outer Radius
number_130 = Number(number_129)
minimum_resolution_12 = Slider(10, range=0..100)
subtraction_49 = Subtraction(A=number_126, B=number_130)
subtraction_50 = Subtraction(A=number_126, B=number_130)
min_step_12 = Slider(0.1, range=0..1)
multiplication_63 = Multiplication(A=subtraction_50, B=minimum_resolution_12)
multiplication_64 = Multiplication(A=minimum_resolution_12, B=subtraction_49)
addition_46 = Addition(A=multiplication_63, B=Slider(1, range=0..1))
series_12 = Series(Start=number_130, Step=min_step_12, Count=addition_46)
list_item_19 = ListItem(List=series_12, Index=multiplication_64, Wrap=True)

number_131 = Number(list_item_19)

number_132 = Number(number_129)
number_133 = Number(number_131)
subtraction_51 = Subtraction(A=number_133, B=number_132)
subtraction_52 = Subtraction(A=number_132, B=number_124)
division_13 = Division(A=subtraction_51, B=Slider(2, range=0..10))
division_14 = Division(A=subtraction_52, B=Slider(2, range=0..10))
addition_47 = Addition(A=number_132, B=division_13)
circle_21 = Circle(Plane=construct_point_18, Radius=number_132)
addition_48 = Addition(A=division_14, B=number_124)
circle_22 = Circle(Plane=construct_point_17, Radius=number_133)
construct_point_19 = ConstructPoint(XCoordinate=addition_47, YCoordinate=0, ZCoordinate=0)
construct_point_20 = ConstructPoint(XCoordinate=addition_48, YCoordinate=0, ZCoordinate=0)
ruled_surface_7 = RuledSurface(CurveA=circle_19, CurveB=circle_21)
ruled_surface_8 = RuledSurface(CurveA=circle_20, CurveB=circle_22)
circle_23 = Circle(Plane=construct_point_19, Radius=Slider(3.4, range=0..3.4))
circle_24 = Circle(Plane=construct_point_20, Radius=Slider(1, range=0..1))
extrude_16 = Extrude(Base=ruled_surface_8, Direction=unit_z_16)
polar_array_7 = PolarArray(Geometry=circle_23, Plane=PlaneXY(0, 0, 0), Count=Slider(4, range=0..10), Angle=6.283185307)  # -> Geometry, Transform
extrude_17 = Extrude(Base=ruled_surface_7, Direction=unit_z_17)
polar_array_8 = PolarArray(Geometry=circle_24, Plane=PlaneXY(0, 0, 0), Count=Slider(2, range=0..10), Angle=6.283185307)  # -> Geometry, Transform
extrude_18 = Extrude(Base=polar_array_7.Geometry, Direction=unit_z_19)  # -> flatten(Extrusion)
solid_union_5 = SolidUnion(Breps=flatten([extrude_17, extrude_16]))
extrude_19 = Extrude(Base=polar_array_8.Geometry, Direction=unit_z_18)  # -> flatten(Extrusion)
cap_holes_6 = CapHoles(Brep=[extrude_19, extrude_18])
solid_difference_7 = SolidDifference(BrepsA=solid_union_5, BrepsB=cap_holes_6)

number_134 = Number(number_132)
subtraction_53 = Subtraction(A=number_134, B=number_125)

number_135 = Number(list_item_17)
number_136 = Number(subtraction_53)

# ----
# Lw1
# End Value Regulated
number_137 = Number(number_135)
multiplication_65 = Multiplication(A=number_137, B=Slider(2, range=0..10))
construct_domain_8 = ConstructDomain(DomainStart=number_121, DomainEnd=multiplication_65)
subtraction_54 = Subtraction(A=multiplication_65, B=number_121)
multiplication_66 = Multiplication(A=subtraction_54, B=Slider(10, range=0..10))
addition_49 = Addition(A=multiplication_66, B=Slider(1, range=0..1))
range_8 = Range(Domain=construct_domain_8, Steps=addition_49)
list_item_20 = ListItem(List=range_8, Index=Slider(0, range=0..100), Wrap=True)

number_138 = Number(list_item_20)

number_139 = Number(number_130)
number_140 = Number(number_137)
addition_50 = Addition(A=number_140, B=number_139)
multiplication_67 = Multiplication(A=number_slider_16, B=addition_50)

# ----
# Number of notches (N1)
# Le1
# Step 7: Number of Notches (N1)
number_141 = Number(explode_tree_4.Branch7)

# ----
# L
# Ln1
# No. of Notch Calculator:
# N has to be integer.
# N = (L-2Le+Ln)/(2Ln)
number_slider_18 = Slider(2, range=0..10)
number_142 = Number(number_119)
multiplication_68 = Multiplication(A=number_slider_18, B=number_141)
subtraction_55 = Subtraction(A=number_142, B=multiplication_68)
number_143 = Number(number_138)
addition_51 = Addition(A=subtraction_55, B=number_143)
multiplication_69 = Multiplication(A=Slider(2, range=0..10), B=number_143)
integer_division_4 = IntegerDivision(A=addition_51, B=multiplication_69)

integer_10 = Integer(integer_division_4)

integer_11 = Integer(integer_10)
multiplication_70 = Multiplication(A=integer_11, B=number_slider_17)
subtraction_56 = Subtraction(A=multiplication_70, B=Slider(1, range=0..1))
number_144 = Number(number_143)
number_145 = Number(number_141)
multiplication_71 = Multiplication(A=number_144, B=subtraction_56)
multiplication_72 = Multiplication(A=number_145, B=Slider(2, range=0..10))
number_146 = Number(number_142)
addition_52 = Addition(A=multiplication_71, B=multiplication_72)
subtraction_57 = Subtraction(A=number_146, B=addition_52)
division_15 = Division(A=subtraction_57, B=Slider(2, range=0..10))
number_147 = Number(number_141)
addition_53 = Addition(A=division_15, B=number_147)
number_148 = Number(addition_53)

number_149 = Number(number_144)
division_16 = Division(A=number_149, B=multiplication_67)
arcsine_4 = ArcSine(Value=division_16)
degrees_4 = Degrees(Radians=arcsine_4)
multiplication_73 = Multiplication(A=Slider(2, range=0..10), B=degrees_4)
number_150 = Number(multiplication_73)

# ----
# Total Bend Angle (phi1)
# a1
# Number of notches (N1)
# Total bend angle (phi1) = N1*a1
# Step 10: Total Bend Angle Calculation
number_151 = Number(number_150)
integer_12 = Integer(integer_11)
multiplication_74 = Multiplication(A=number_151, B=integer_12)
number_152 = Number(multiplication_74)

# ----
# Notch Overcut (Lw2)
# w
# Wall Width (w)
# Ro
# Lw2
# Lw2
# Ri
# Notch Overcut  (Lw2) Compute:
# Minimum Lw set to be 0.
# Maximum Lw set to be Ri+Ro.
# This block sets Lw within permissible ranges dynamically
# End Value Regulated
# Ln2
# Step 5: Notch Overcut (Lw2)
# Notch Length (Ln2)
# N2
# Ln2
# Lw2
# Lef2
# End Value Regulated
# Notch Length Compute:
# Minimum Ln set to be 1 mm by slider.
# Maximum will be Ro.
# This block sets Ln within permissible ranges dynamically
# Step 6: Notch Length Calculate (Ln2)
# a2
# phi2
# L
# Number of notches (N2)
# Ln2
# Le2
# No. of Notch Calculator:
# N has to be integer.
# N = (L-2Le+Ln)/(2Ln)
# Step 7: Number of Notches (N2)
# Step 8: Tip End Thickness
# Compensation
# L2
# Ln2
# N2
# Lef2
# Le2
# Le2
# As N is integer, to adjust for extra length, the thickness of both ends of the catheter is increased by half of residual length to keep catheter height fixed.
# Lef= Le + ((L-(2N-1)Ln)/2)
# Ln2
# Lw2
# Angle per Notch (a2)
# Max Angle per Notch (a2) = 2sininv(Ln/2(Ro+Lw2))
# Ro
# Step 9: Angle per Notch Calculation
# Total Bend Angle (phi2)
# a
# Number of notches (N2)
# Total bend angle (phi) = N2*a2
# Step 10: Total Bend Angle Calculation
number_slider_19 = Slider(2, range=0..10)
number_153 = Number(number_134)
number_154 = Number(number_125)
number_155 = Number(number_134)
number_156 = Number(explode_tree_4.Branch8)
number_157 = Number(explode_tree_4.Branch9)
number_158 = Number(explode_tree_4.Branch10)
subtraction_58 = Subtraction(A=number_155, B=number_154)
number_159 = Number(number_142)
number_160 = Number(number_158)
multiplication_75 = Multiplication(A=Slider(2, range=0..10), B=number_158)
multiplication_76 = Multiplication(A=number_160, B=Slider(2, range=0..10))
number_161 = Number(number_159)
construct_domain_9 = ConstructDomain(DomainStart=number_156, DomainEnd=number_154)
subtraction_59 = Subtraction(A=number_154, B=number_156)
subtraction_60 = Subtraction(A=number_159, B=multiplication_75)
number_162 = Number(number_158)
multiplication_77 = Multiplication(A=subtraction_59, B=Slider(10, range=0..10))
addition_54 = Addition(A=multiplication_77, B=Slider(1, range=0..1))
range_9 = Range(Domain=construct_domain_9, Steps=addition_54)
list_item_21 = ListItem(List=range_9, Index=Slider(0, range=0..100), Wrap=True)
number_163 = Number(list_item_21)
number_164 = Number(number_163)
number_165 = Number(number_164)
addition_55 = Addition(A=number_165, B=number_153)
multiplication_78 = Multiplication(A=number_slider_19, B=addition_55)
multiplication_79 = Multiplication(A=number_164, B=Slider(2, range=0..10))
construct_domain_10 = ConstructDomain(DomainStart=number_157, DomainEnd=multiplication_79)
subtraction_61 = Subtraction(A=multiplication_79, B=number_157)
multiplication_80 = Multiplication(A=subtraction_61, B=Slider(10, range=0..10))
addition_56 = Addition(A=multiplication_80, B=Slider(1, range=0..1))
range_10 = Range(Domain=construct_domain_10, Steps=addition_56)
list_item_22 = ListItem(List=range_10, Index=Slider(0, range=0..100), Wrap=True)
number_166 = Number(list_item_22)
number_167 = Number(number_166)
number_168 = Number(number_167)
number_169 = Number(number_168)
division_17 = Division(A=number_169, B=multiplication_78)
arcsine_5 = ArcSine(Value=division_17)
degrees_5 = Degrees(Radians=arcsine_5)
multiplication_81 = Multiplication(A=Slider(2, range=0..10), B=degrees_5)
addition_57 = Addition(A=subtraction_60, B=number_167)
number_170 = Number(multiplication_81)
number_171 = Number(number_170)
multiplication_82 = Multiplication(A=Slider(2, range=0..10), B=number_167)
integer_division_5 = IntegerDivision(A=addition_57, B=multiplication_82)
integer_13 = Integer(integer_division_5)
integer_14 = Integer(integer_13)
multiplication_83 = Multiplication(A=integer_14, B=Slider(2, range=0..10))
subtraction_62 = Subtraction(A=multiplication_83, B=Slider(1, range=0..1))
integer_15 = Integer(integer_14)
multiplication_84 = Multiplication(A=number_171, B=integer_15)
multiplication_85 = Multiplication(A=number_168, B=subtraction_62)
addition_58 = Addition(A=multiplication_85, B=multiplication_76)
subtraction_63 = Subtraction(A=number_161, B=addition_58)
division_18 = Division(A=subtraction_63, B=Slider(2, range=0..10))
number_172 = Number(multiplication_84)
addition_59 = Addition(A=division_18, B=number_162)
number_173 = Number(addition_59)
number_174 = Number(subtraction_58)
panel_71 = Panel(number_174)
panel_72 = Panel(number_163)
panel_73 = Panel(number_166)
panel_74 = Panel(integer_13)
panel_75 = Panel(number_173)
panel_76 = Panel(number_170)
panel_77 = Panel(number_172)

panel_78 = Panel(number_123)
panel_79 = Panel(number_129)
panel_80 = Panel(number_131)
panel_81 = Panel(number_118)
panel_82 = Panel(number_119)
panel_83 = Panel(number_136)
panel_84 = Panel(number_135)
panel_85 = Panel(number_138)
panel_86 = Panel(integer_10)
panel_87 = Panel(number_148)
panel_88 = Panel(number_150)
panel_89 = Panel(number_152)
# Ln
# Le
# Ln
# Total Bend Angle (phi)
merge_12 = Merge(Data1=create_border_4, Data2=create_grid_10, Data3=create_grid_11)
panel_90 = Panel(merge_12)
create_grid_12 = CreateGrid(UIElements=merge_12, ColumnDefinitions=panel_66, ElementColumn=panel_67, ElementRowSpan=1, ElementColumnSpan=1)
set_label_contents_7 = SetLabelContents(LabelToModify=create_label_47, NewLabelContents=panel_77)
set_label_contents_8 = SetLabelContents(LabelToModify=create_label_45, NewLabelContents=panel_88)
set_label_contents_9 = SetLabelContents(LabelToModify=create_label_46, NewLabelContents=panel_89)
set_label_contents_10 = SetLabelContents(LabelToModify=create_label_52, NewLabelContents=panel_76)
addition_60 = Addition(A=panel_81, B=panel_87)
addition_61 = Addition(A=panel_81, B=panel_75)
number_175 = Number(number_134)
negative_7 = Negative(Value=number_175)
negative_8 = Negative(Value=number_175)
construct_point_21 = ConstructPoint(XCoordinate=negative_8, YCoordinate=negative_7, ZCoordinate=addition_60)
number_176 = Number(panel_84)
xz_plane_5 = XZPlane(Origin=construct_point_21)
number_177 = Number(panel_85)
multiplication_86 = Multiplication(A=number_177, B=Slider(2, range=0..10))
multiplication_87 = Multiplication(A=number_175, B=Slider(-2, range=-10..10))
unit_z_20 = UnitZ(Factor=multiplication_86)
rectangle_5 = Rectangle(Plane=xz_plane_5, XSize=number_176, YSize=number_177, Radius=0)  # -> Rectangle, Length
box_rectangle_3 = BoxRectangle(Rectangle=rectangle_5.Rectangle, Height=multiplication_87)
number_178 = Number(panel_86)
linear_array_5 = LinearArray(Geometry=box_rectangle_3, Direction=unit_z_20, Count=number_178)  # -> Geometry, Transform

# ----
# Lw2
# Ln2
# N2
negative_9 = Negative(Value=number_175)
construct_point_22 = ConstructPoint(XCoordinate=number_175, YCoordinate=negative_9, ZCoordinate=addition_61)
number_179 = Number(panel_73)
number_180 = Number(panel_72)
multiplication_88 = Multiplication(A=number_179, B=Slider(2, range=0..10))
number_181 = Number(panel_74)
negative_10 = Negative(Value=number_180)
xz_plane_6 = XZPlane(Origin=construct_point_22)
unit_z_21 = UnitZ(Factor=multiplication_88)
rectangle_6 = Rectangle(Plane=xz_plane_6, XSize=negative_10, YSize=number_179, Radius=0)  # -> Rectangle, Length
box_rectangle_4 = BoxRectangle(Rectangle=rectangle_6.Rectangle, Height=multiplication_87)
linear_array_6 = LinearArray(Geometry=box_rectangle_4, Direction=unit_z_21, Count=number_181)  # -> Geometry, Transform

solid_union_6 = SolidUnion(Result=[linear_array_6.Geometry, linear_array_5.Geometry])
solid_difference_8 = SolidDifference(BrepsA=solid_difference_7, BrepsB=solid_union_6)
brep_4 = Brep(solid_difference_8)
set_3d_view_4 = Set3DView(_3DView=create_3d_view_4, MeshToDisplay=brep_4, MeshColors=value_listener_7.Values)

panel_91 = Panel(solid_difference_8)

# ----
# Create Tabs
panel_92 = Panel("""Unidirectional
Bidirectional Symmetric
Bidirectional Asymmetric
Bidirectional Overnotched""")
tabbed_view = TabbedView(
    TabNames=panel_92,
    TabTextSize=Slider(23, range=0..100),
    Tab0=flatten(create_grid_7),
    Tab1=flatten(create_grid_9),
    Tab2=flatten(create_grid_12),
    Tab3=flatten(create_grid_5))

# ----
# Create UI
boolean_toggle_3 = BooleanToggle(True)
launch_window = LaunchWindow(
    Show=boolean_toggle_3,
    Name="PRINTABLE APPLICATION SPECIFIC ENDOSCOPE TIP (PACET)",
    Width=get_screen_dimensions.Width,
    Height=get_screen_dimensions.Height,
    FontFamily="ARIAL",
    ChildStatus=0,
    EnableHorizScroll=False)
add_elements = AddElements(Window=launch_window, Elements=flatten(tabbed_view), DoVLChecking=True)  # -> AddedElements, ElementNames
